# Grasshopper definition unicamTools.gh (Grasshopper 1.0.7)
# plug-ins: UiPlus, Human, MetaHopper, Bumblebee, Wombat, HDTTreeUtils, Pufferfish

ui_scroll_integer = UiScrollInteger(Label="H", SelectedInteger=13, Wrap=True, Increment=1, Bounds=Domain(0, 23))
ui_scroll_integer_2 = UiScrollInteger(Label="H", SelectedInteger=12, Wrap=True, Increment=1, Bounds=Domain(0, 23))
ui_values = UiValues(Element=ui_scroll_integer_2)
ui_values_2 = UiValues(Element=ui_scroll_integer)
ui_slider = UiSlider(Label="Grid size (m)", Value=10, Bounds=Domain(1, 15), Increment=0.5)
ui_slider_2 = UiSlider(Label="comfort cursor X", Value=0.5, Bounds=Domain(0, 1), Increment=0.1)
ui_slider_3 = UiSlider(Label="comfort cursor Y", Value=0.5, Bounds=Domain(0, 1), Increment=0.1)
ui_slider_4 = UiSlider(Label="Radius m", Value=0.5, Bounds=Domain(1, 30), Increment=1)
ui_values_3 = UiValues(Element=ui_slider)  # -> flatten(Values)

# ---- group: repday 5.3.3 / input: filePath and names
location_worksheet_name = Panel("locations")
weather_worksheet_name = Panel("weather_data_1hr")
new_workbook = Panel("DBresults")
relative_path = RelativePath(Path=".\")

# ---- group: repday 5.3.3 / logic: check
make_directory_paths = MakeDirectoryPaths(
    ghfilepath=relative_path,
    location_worksheet_name=location_worksheet_name,
    weather_worksheet_name=weather_worksheet_name,
    db_workbook=new_workbook)  # -> ghfilepath_3, location_path_2, weather_data_1hr_path_2, location_worksheet_name_3, weather_worksheet_name_3, db_workbook_4
check_directory_consistence = CheckDirectoryConsistence(location_path=make_directory_paths.ghfilepath_3, weather_data_1hr_path=make_directory_paths.location_path_2)  # -> message_2, check_2
location_worksheet_name_2 = Data(make_directory_paths.location_worksheet_name_3)
weather_worksheet_name_2 = Data(make_directory_paths.weather_worksheet_name_3)
run = BooleanToggle(True)
canrun = CanRun(check=check_directory_consistence.check_2, run=run)
get_cities_from_coordinates = GetCitiesFromCoordinates(run=canrun, location_path=make_directory_paths.location_path_2)  # -> cities_3, loc_id_2
message = Panel(check_directory_consistence.message_2)

# ----
ui_spacer = UiSpacer(Width=20, Horizontal=invert(False))
merge = Merge(Data1=flatten(ui_slider), Data2=ui_spacer)  # -> flatten(Result)
ui_values_4 = UiValues(Element=ui_slider_2)  # -> flatten(Values)
ui_values_5 = UiValues(Element=ui_slider_3)  # -> flatten(Values)
ui_values_6 = UiValues(Element=ui_slider_4)  # -> flatten(Values)

# ---- group: UWG morphing 1.0.0
panel = Panel("""0 To 1
0 To 1
0 To 1
0.1 To 50
0 To 1""")
panel_2 = Panel("""0.25
0.7
0.5
0.1
0.5""")
panel_3 = Panel("""Albedo
Tree latent
Grass latent
Obstacle hight
Vegetation Cover""")
panel_4 = Panel("albedo")
ui_slider_5 = UiSlider(Label=panel_3, Value=panel_2, Bounds=panel, Increment=0.1)

ui_load_button = UiLoadButton(Label="Load epw file", Extensions="Energy Plus Weather | epw", Multiple=False)

ui_slider_6 = UiSlider(Label="Watts per area", Value=8, Bounds=Domain(4, 20), Increment=0.1)
merge_2 = Merge(Data1=ui_slider_6)

# ----
colrange = LBColorRange(index=Slider(4, range=0..26))  # -> reverse(colors); plug-in component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
legendpar = LBLegendParameters(colors=colrange, num_decimals=2)  # -> leg_par; plug-in component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
colrange_2 = LBColorRange(index=Slider(5, range=0..26))  # -> colors; plug-in component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
range = Range(Domain=Domain(0, 1), Steps=10)
legendpar_2 = LBLegendParameters(colors=colrange_2, continuous_leg=Slider(1, range=0..1))  # -> leg_par; plug-in component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
gradient = Gradient(
    LowerLimit=0,
    UpperLimit=1,
    Parameter=range,
    stops=[0: RGB(29, 53, 87), 0.25: RGB(70, 124, 158), 0.5: RGB(167, 218, 219), 0.75: RGB(255, 220, 156), 1: RGB(230, 57, 72)])
legendpar_3 = LBLegendParameters(colors=gradient)  # -> leg_par; plug-in component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
number_slider = Slider(1, range=0..1)

panel_5 = Panel("Start period")
ui_pick_date = UiPickDate(DateTime=638356500000000000, Long=False)
ui_label = UiLabel(Label="End period")
ui_label_2 = UiLabel(Label="Start period")
ui_pick_date_2 = UiPickDate(DateTime=638084304000000000, Long=False)
panel_6 = Panel("""Shadows Analyse
Radiation Analyse
Comfort Analyse""")
ui_load_button_2 = UiLoadButton(Label="Load EPW file", Extensions="Energy Plus Weather | epw", Multiple=True)
merge_3 = Merge(
    Data1=ui_label_2,
    Data2=ui_pick_date_2,
    Data3=ui_scroll_integer_2,
    Data4=ui_label,
    Data5=ui_pick_date,
    Data6=ui_scroll_integer)
ui_align = UiAlign(Element=ui_load_button_2, Alignment=3)
ui_button = UiButton(Label=panel_6)
ui_values_7 = UiValues(Element=ui_load_button_2)
ui_align_2 = UiAlign(Element=merge_3, Alignment=3)
panel_7 = Panel("""0
0
0
1
1
1""")
panel_8 = Panel("""0
1
2
0
1
2""")
ui_align_3 = UiAlign(Element=ui_button, Alignment=3)
ui_grid_layout = UiGridLayout(Elements=merge_3, Columns=panel_8, Rows=panel_7)
start_update_analise_blue = Button()
ui_spacer_2 = UiSpacer(Width=20, Horizontal=invert(False))
ui_spacer_3 = UiSpacer(Width=20, Horizontal=invert(False))
ui_spacer_4 = UiSpacer(Width=20, Horizontal=invert(False))
merge_4 = Merge(
    Data1=flatten(ui_button),
    Data2=flatten(ui_slider_2),
    Data3=flatten(ui_slider_3),
    Data4=flatten(ui_slider_4),
    Data5=ui_spacer_2)  # -> flatten(Result)
merge_5 = Merge(Data1=flatten(ui_load_button_2), Data2=ui_spacer_3)  # -> flatten(Result)
merge_6 = Merge(Data1=flatten(ui_grid_layout), Data2=ui_spacer_4)  # -> flatten(Result)

ui_values_8 = UiValues(Element=ui_pick_date_2)
ui_values_9 = UiValues(Element=ui_pick_date)
ui_values_10 = UiValues(Element=ui_button)  # -> flatten(Values)
list_item = ListItem(List=ui_values_10, Index=0, Wrap=True)  # -> Item, Item1, Item2
deconstruct_date = DeconstructDate(Date=ui_values_8)  # -> Year, Month, Day, Hour, Minute, Second
deconstruct_date_2 = DeconstructDate(Date=ui_values_9)  # -> Year, Month, Day, Hour, Minute, Second
data_recorder = DataRecorder(ui_values_9, DataLimit=-10, RecordData=True)
panel_9 = Panel(data_recorder)
importepw = LBImportEPW(epw_file=ui_values_7)  # -> location, dry_bulb_temperature, dew_point_temperature, relative_humidity, wind_speed, wind_direction, direct_normal_rad, diffuse_horizontal_rad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; plug-in component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
analysisperiod = LBAnalysisPeriod(
    start_month=deconstruct_date.Month,
    start_day=deconstruct_date.Day,
    start_hour=ui_values,
    end_month=deconstruct_date_2.Month,
    end_day=deconstruct_date_2.Day,
    end_hour=ui_values_2)  # -> period, hoys, dates; plug-in component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
applyper = LBApplyAnalysisPeriod(data=importepw.dry_bulb_temperature, period=analysisperiod.period)  # -> data; plug-in component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
xdata = LBDeconstructData(data=applyper)  # -> header, values; plug-in component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
sort_list = SortList(Keys=xdata.values)  # -> Keys, ValuesValuesA
list_item_2 = ListItem(List=sort_list.Keys, Index=-1, Wrap=True)
analysisperiod_2 = LBAnalysisPeriod(
    start_month=deconstruct_date_2.Month,
    start_day=deconstruct_date_2.Day,
    start_hour=ui_values_2,
    end_month=deconstruct_date_2.Month,
    end_day=deconstruct_date_2.Day,
    end_hour=ui_values_2)  # -> period, hoys, dates; plug-in component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
applyper_2 = LBApplyAnalysisPeriod(data=importepw.direct_normal_rad, period=analysisperiod_2.period)  # -> data; plug-in component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
applyper_3 = LBApplyAnalysisPeriod(data=importepw.diffuse_horizontal_rad, period=analysisperiod_2.period)  # -> data; plug-in component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
applyper_4 = LBApplyAnalysisPeriod(data=importepw.horizontal_infrared_rad, period=analysisperiod_2.period)  # -> data; plug-in component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
applyper_5 = LBApplyAnalysisPeriod(data=importepw.dry_bulb_temperature, period=analysisperiod_2.period)  # -> data; plug-in component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
applyper_6 = LBApplyAnalysisPeriod(data=importepw.relative_humidity, period=analysisperiod_2.period)  # -> data; plug-in component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
applyper_7 = LBApplyAnalysisPeriod(data=importepw.wind_speed, period=analysisperiod_2.period)  # -> data; plug-in component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
sunpath = LBSunPath(location=importepw.location, hoys=analysisperiod.hoys, center_pt=Point(0, 0, 0), scale=1)  # -> out, vectors, altitudes, azimuths, hoys, sun_pts, analemma, daily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; plug-in component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
skymatrix = LBCumulativeSkyMatrix(
    location=importepw.location,
    direct_rad=importepw.direct_normal_rad,
    diffuse_rad=importepw.diffuse_horizontal_rad,
    hoys=analysisperiod_2.hoys)  # -> out, sky_mtx; plug-in component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

# ---- group: make EPW 2.0.1 / 1hr csv
concatenate = Concatenate(FragmentA=relative_path, FragmentB="weather_data_1hr.csv")
read_file = ReadFile(File=concatenate, PerLineParse=True)
cull_index = CullIndex(List=read_file, Indices=0, Wrap=True)
list_item_3 = ListItem(List=read_file, Index=0, Wrap=True)
text_split = TextSplit(Text=cull_index, Separators=",")  # -> simplify(Result)
text_split_2 = TextSplit(Text=list_item_3, Separators=",")  # -> simplify(Result)
flip_matrix = FlipMatrix(Data=text_split)
keys = Panel(text_split_2)
list_length = ListLength(List=keys)
csv = ValueList({"loc_id": "0", "date": "1", "time": "2", "isdaytime": "3", "tempC": "4", "tempF": "5", "windspeedMiles": "6", "windspeedKmph": "7", "winddirdegree": "8", "winddir16point": "9"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}, selected="loc_id")
valuelist_name = Panel("csv")
series = Series(Start=0, Step=1, Count=list_length)
csv_values = Text(flip_matrix)
panel_10 = Panel(text_split_2)
values = Text(series)
pvl = PopulateValueList(Name=valuelist_name, Keys=keys, Values=values)  # inputs Keys: list, Values: list
# ---------- pvl: Python ----------
"""
Populate Value List
    Inputs:
        Name: {item,str}
        Keys: {list,str}
        Values: {list,str}
    Outputs:
    Remarks:
        Author: Anders Holden Deleuran (BIG IDEAS)
        Rhino: 6.30.20266.14531
        Version: 210108
"""

ghenv.Component.Name = "PopulateValueList"
ghenv.Component.NickName = "PVL"

import Grasshopper as gh

if Keys and Values:
    for obj in ghenv.Component.OnPingDocument().Objects:
        if type(obj) is gh.Kernel.Special.GH_ValueList:
            if obj.NickName == Name:
                selected = obj.FirstSelectedItem.Name
                obj.ListItems.Clear()
                for k,v in zip(Keys,Values):
                    vli = gh.Kernel.Special.GH_ValueListItem(str(k),str('"' + v + '"'))
                    obj.ListItems.Add(vli)
                if selected in Keys:
                    obj.SelectItem(Keys.index(selected))
                obj.ExpireSolution(True)
# ---------- end pvl ----------
tree_branch = TreeBranch(Tree=csv_values, Path=csv, MaintainPaths=True)
csv_2 = ValueList({"loc_id": "0", "date": "1", "time": "2", "isdaytime": "3", "tempC": "4", "tempF": "5", "windspeedMiles": "6", "windspeedKmph": "7", "winddirdegree": "8", "winddir16point": "9"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}, selected="date")
valuelist_name_2 = Panel("year")

# ---- group: UWG morphing 1.0.0
layer_table = LayerTable(Update=True, AutoUpdate=True)  # -> Layers, FullLayerPaths, LayerColors, Linetypes, MaterialNames, Visible, PrintWidth, PrintColor
match_text = MatchText(Text=layer_table.Layers, Pattern="Cntx_*", Case=True)
match_text_2 = MatchText(Text=layer_table.Layers, Pattern="Trn_*", Case=True)
replace_text = ReplaceText(Text="Cntx_*", Find="*", RecursiveReplace=False)
cull_pattern = CullPattern(List=layer_table.Layers, CullPattern=match_text)
replace_text_2 = ReplaceText(Text=cull_pattern, Find=replace_text, RecursiveReplace=False)
replace_text_3 = ReplaceText(Text=cull_pattern, Find="_", Replace="__", RecursiveReplace=False)
replace_text_4 = ReplaceText(Text="Trn_*", Find="*", RecursiveReplace=False)
cull_pattern_2 = CullPattern(List=layer_table.Layers, CullPattern=match_text_2)
start_update_uwgmorphing_orange = Button()
replace_text_5 = ReplaceText(Text=cull_pattern_2, Find=replace_text_4, RecursiveReplace=False)
replace_text_6 = ReplaceText(Text=cull_pattern_2, Find="_", Replace="__", RecursiveReplace=False)
match_text_3 = MatchText(Text=layer_table.Layers, Pattern="Blg_*", Case=True)
replace_text_7 = ReplaceText(Text="Blg_*", Find="*", RecursiveReplace=False)
cull_pattern_3 = CullPattern(List=layer_table.Layers, CullPattern=match_text_3)
replace_text_8 = ReplaceText(Text=cull_pattern_3, Find=replace_text_7, RecursiveReplace=False)
list_length_2 = ListLength(List=cull_pattern_3)
series_2 = Series(Start=1, Step=1, Count=list_length_2)
format = Format(Format="{0}° Blgset: {1}", Culture=127, Data0=series_2, Data1=replace_text_8)
dynamic_geometry_pipeline = DynamicGeometryPipeline(
    LayerFilter=cull_pattern_3,
    TypeFilter="Brep",
    NameFilter="*",
    GroupByLayer=False,
    GroupByType=False,
    IncludeHidden=True,
    IncludeLocked=True,
    enableFullPath=False,
    listenToAttributes=True)
ui_values_11 = UiValues(Element=ui_load_button)
officesolids = Geometry(dynamic_geometry_pipeline)
text_split_3 = TextSplit(Text=ui_values_11, Separators="\")
list_length_3 = ListLength(List=ui_values_11)
cull_index_2 = CullIndex(List=text_split_3, Indices=-1, Wrap=True)
list_item_4 = ListItem(List=text_split_3, Index=-1, Wrap=True)
replace_text_9 = ReplaceText(Text=list_item_4, Find=".epw", RecursiveReplace=False)
ui_values_12 = UiValues(Element=ui_slider_5)
text_join = TextJoin(Text=cull_index_2, Join="\")
replace_text_10 = ReplaceText(Text=replace_text_9, Find=" ", RecursiveReplace=False)
format_2 = Format(Format="You are load {0}", Culture=127, Data0=list_item_4)
format_3 = Format(Format="Load the file first", Culture=127, Data0=list_item_4)
ui_label_3 = UiLabel()
ui_values_13 = UiValues(Element=ui_slider_6)
concatenate_2 = Concatenate(FragmentA=replace_text_10, FragmentB="_UWG")
stream_filter = StreamFilter(Gate=list_length_3, Stream0=format_3, Stream1=format_2)
ui_align_4 = UiAlign(Element=ui_slider_5, Alignment=3)
ui_align_5 = UiAlign(Element=ui_load_button, Alignment=3)
format_4 = Format(Format="{0}\{1}.epw", Culture=127, Data0=text_join, Data1=concatenate_2)
ui_label_4 = UiLabel(Element=ui_label_3, Label=stream_filter, Style=3)
series_3 = Series(Start=0, Step=1, Count=3)
ui_spacer_5 = UiSpacer(Width=20, Horizontal=invert(False))
ui_spacer_6 = UiSpacer(Width=20, Horizontal=invert(False))
ui_spacer_7 = UiSpacer(Width=20, Horizontal=invert(False))
ui_spacer_8 = UiSpacer(Width=20, Horizontal=invert(False))
ui_spacer_9 = UiSpacer(Width=20, Horizontal=invert(False))
ui_spacer_10 = UiSpacer(Width=20, Horizontal=invert(False))
merge_7 = Merge(Data1=merge_2, Data2=ui_spacer_6)  # -> flatten(Result)
merge_8 = Merge(Data1=ui_load_button, Data2=ui_label_3, Data3=ui_spacer_7)  # -> flatten(Result)
ui_spacer_11 = UiSpacer(Width=20, Horizontal=invert(False))
merge_9 = Merge(Data1=ui_slider_5, Data2=ui_spacer_9)  # -> flatten(Result)
explode_tree = ExplodeTree(Data=ui_values_12)  # -> Branch0, Branch1, Branch2, Branch3, Branch4
geometry_pipeline = GeometryPipeline(
    GroupByLayer=False,
    GroupByType=False,
    IncludeHidden=True,
    IncludeLocked=True,
    LayerFilter="*",
    NameFilter="*",
    SublayerFiltering=True,
    TypeFilter=1073741885)
importepw_2 = LBImportEPW(epw_file=flatten(ui_values_11))  # -> location, dry_bulb_temperature, dew_point_temperature, relative_humidity, wind_speed, wind_direction, direct_normal_rad, diffuse_horizontal_rad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; plug-in component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
importepw_3 = LBImportEPW(epw_file=flatten(format_4))  # -> location, dry_bulb_temperature, dew_point_temperature, relative_humidity, wind_speed, wind_direction, direct_normal_rad, diffuse_horizontal_rad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; plug-in component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
bounding_box = BoundingBox(Content=flatten(geometry_pipeline), Plane=PlaneXY(0, 0, 0), UnionBox=True)  # -> Box, Box_2
utci = LBUTCIComfort(
    air_temp=importepw_2.dry_bulb_temperature,
    rel_humid=importepw_2.relative_humidity,
    wind_vel=importepw_2.wind_speed,
    run=True)  # -> out, utci, comfort, condition, category, comf_obj; plug-in component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
utci_2 = LBUTCIComfort(
    air_temp=importepw_3.dry_bulb_temperature,
    rel_humid=importepw_3.relative_humidity,
    wind_vel=importepw_3.wind_speed,
    run=True)  # -> out, utci, comfort, condition, category, comf_obj; plug-in component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
volume = Volume(Geometry=bounding_box.Box)  # -> Volume, Centroid
scale_nu = ScaleNU(Geometry=bounding_box.Box, Plane=volume.Centroid, ScaleX=1.4, ScaleY=1.4, ScaleZ=1)  # -> Geometry, Transform
merge_10 = Merge(
    Data1=importepw_2.dry_bulb_temperature,
    Data2=importepw_3.dry_bulb_temperature,
    Data3=importepw_2.relative_humidity,
    Data4=importepw_3.relative_humidity,
    Data5=utci.utci,
    Data6=utci_2.utci)
partition_list = PartitionList(List=merge_10, Size=2)
xdata_2 = LBDeconstructData(data=partition_list)  # -> header, flatten(values); plug-in component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
list_length_4 = ListLength(List=xdata_2.values)
tree_statistics = TreeStatistics(Tree=partition_list)  # -> Paths, Length, Count
division = Division(A=list_length_4, B=tree_statistics.Count)
partition_list_2 = PartitionList(List=xdata_2.values, Size=division)
box_corners = BoxCorners(Box=scale_nu.Geometry)  # -> CornerA, CornerB, CornerC, CornerD, CornerE, CornerF, CornerG, CornerH
gradient_2 = Gradient(
    LowerLimit=0,
    UpperLimit=1,
    Parameter=[0, 0.1, 0.2, 0.3, 0.4, 0.5, 0.6, 0.7, 0.8, 0.9, 1],
    stops=[0: RGB(0, 56, 102), 0.2: RGB(1, 143, 148), 0.4: RGB(51, 189, 90), 0.6: RGB(255, 187, 0), 0.8: RGB(209, 89, 59), 1: RGB(173, 23, 126)])
gradient_3 = Gradient(
    LowerLimit=0,
    UpperLimit=1,
    Parameter=[0, 0.1, 0.2, 0.3, 0.4, 0.5, 0.6, 0.7, 0.8, 0.9, 1],
    stops=[0: RGB(120, 0, 0), 0.248: RGB(194, 17, 29), 0.505: RGB(252, 240, 212), 0.746: RGB(102, 155, 189), 1: RGB(0, 48, 74)])
gradient_4 = Gradient(
    LowerLimit=0,
    UpperLimit=1,
    Parameter=[0, 0.1, 0.2, 0.3, 0.4, 0.5, 0.6, 0.7, 0.8, 0.9, 1],
    stops=[0: RGB(29, 53, 87), 0.25: RGB(70, 124, 158), 0.5: RGB(167, 218, 219), 0.75: RGB(255, 220, 156), 1: RGB(230, 57, 72)])
sort_list_2 = SortList(Keys=partition_list_2)  # -> Keys, ValuesValuesA
list_item_5 = ListItem(List=sort_list_2.Keys, Index=0, Wrap=True)  # -> Item1, Item
entwine = Entwine(Branch00=gradient_2, Branch01=gradient_3, Branch02=gradient_4, FlattenInputs=True)
expression = Expression(a=list_item_5.Item1, Expression="If(a>100, 100, a)")
expression_2 = Expression(a=list_item_5.Item, Expression="If(a>100, 100, a)")
expression_3 = Expression(a=expression, Expression="If(a<0, 0, a)")
expression_4 = Expression(a=expression_2, Expression="If(a<0, 0, a)")
legendpar_4 = LBLegendParameters(min=expression_4, max=expression_3, colors=entwine, continuous_leg=Slider(1, range=0..1))  # -> leg_par; plug-in component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
longest_list = LongestList(ListListA=legendpar_4, ListListB=partition_list, PaddingMode=2)  # -> ListListA, ListListB
xdata_3 = LBDeconstructData(data=partition_list)  # -> header, values; plug-in component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
merge_11 = Merge(Data1=replace_text_10, Data2=concatenate_2)
xheader = LBDeconstructHeader(header=xdata_3.header)  # -> flatten(data_type), flatten(unit), flatten(a_period), metadata; plug-in component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
format_5 = Format(Format="city: {0}", Culture=127, Data0=merge_11)
longest_list_2 = LongestList(ListListA=flatten(xdata_3.header), ListListB=format_5, PaddingMode=4)  # -> ListListA, ListListB
constrheader = LBConstructHeader(
    data_type=graft(xheader.data_type),
    unit=graft(xheader.unit),
    a_period=graft(xheader.a_period),
    metadata=graft(longest_list_2.ListListB))  # -> flatten(header); plug-in component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
data = LBConstructData(header=graft(constrheader), values=xdata_3.values)  # -> data; plug-in component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
hourlyplot = LBHourlyPlot(data=flatten(data), base_pt=box_corners.CornerC, reverse_y=False, legend_par=flatten(longest_list.ListListA))  # -> out, mesh, legend, borders, labels, title, vis_set; plug-in component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

# ----
list_length_5 = ListLength(List=cull_pattern)

# ---- group: UWG morphing 1.0.0
list_item_6 = ListItem(List=replace_text_6, Index=0, Wrap=True)
list_item_7 = ListItem(List=replace_text_5, Index=0, Wrap=True)
dynamic_geometry_pipeline_2 = DynamicGeometryPipeline(
    LayerFilter=cull_pattern_2,
    TypeFilter="Brep",
    NameFilter="*",
    GroupByLayer=False,
    GroupByType=False,
    IncludeHidden=True,
    IncludeLocked=True,
    enableFullPath=False,
    listenToAttributes=True)
list_length_6 = ListLength(List=dynamic_geometry_pipeline_2)
panel_11 = Panel("""0 To 1
0 To 1
0 To 100
0 To 2660000""")
panel_12 = Panel("""0.5
0.5
1
2660000""")
panel_13 = Panel("""Albedo
Thickness m
Conductivity  W/m-K
Volumetric heat capacity J/m3-K""")
equality = Equality(FirstNumber=list_length_6, SecondNumber=1)  # -> Equality, Inequality
format_6 = Format(Format="Insert a valid geometry into layer \"{0}\"", Culture=127, Data0=list_item_6)
format_7 = Format(Format="The terrain is loaded into layer \"{0}\"", Culture=127, Data0=list_item_6)
stream_filter_2 = StreamFilter(Gate=equality.Equality, Stream0=format_6, Stream1=format_7)
ui_slider_7 = UiSlider(Label=panel_13, Value=panel_12, Bounds=panel_11, Increment=0.1)
ui_label_5 = UiLabel()
ui_label_6 = UiLabel(Element=ui_label_5, Label=stream_filter_2, Style=3)
merge_12 = Merge(Data1=ui_label_5, Data2=ui_slider_7)

panel_14 = Panel("""LargeOffice
MediumOffice
SmallOffice
MidriseApartment
HighriseApartment
Retail
StripMall
PrimarySchool
SecondarySchool
SmallHotel
LargeHotel
Hospital
Outpatient
Laboratory
Warehouse
SuperMarket
FullServiceRestaurant
QuickServiceRestaurant
Courthouse
LargeDataCenterHighITE
LargeDataCenterLowITE
SmallDataCenterHighITE
SmallDataCenterLowITE""")
duplicate_data = DuplicateData(Data=panel_14, Number=list_length_2, Order=True)
list_length_7 = ListLength(List=panel_14)
partition_list_3 = PartitionList(List=duplicate_data, Size=list_length_7)  # -> simplify(Chunks)
ui_dropdown_list = UiDropdownList(Values=partition_list_3, Index=0)  # -> simplify(Elements)

panel_15 = Panel("""1980_2004::ClimateZone1::Mass
1980_2004::ClimateZone1::Metal Building
1980_2004::ClimateZone1::SteelFramed
1980_2004::ClimateZone1::WoodFramed
1980_2004::ClimateZone2::Mass
1980_2004::ClimateZone2::Metal Building
1980_2004::ClimateZone2::SteelFramed
1980_2004::ClimateZone2::WoodFramed
1980_2004::ClimateZone3::Mass
1980_2004::ClimateZone3::Metal Building
1980_2004::ClimateZone3::SteelFramed
1980_2004::ClimateZone3::WoodFramed
1980_2004::ClimateZone4::Mass
1980_2004::ClimateZone4::Metal Building
1980_2004::ClimateZone4::SteelFramed
1980_2004::ClimateZone4::WoodFramed
1980_2004::ClimateZone5::Mass
1980_2004::ClimateZone5::Metal Building
1980_2004::ClimateZone5::SteelFramed
1980_2004::ClimateZone5::WoodFramed
1980_2004::ClimateZone6::Mass
1980_2004::ClimateZone6::Metal Building
1980_2004::ClimateZone6::SteelFramed
1980_2004::ClimateZone6::WoodFramed
1980_2004::ClimateZone7::Mass
1980_2004::ClimateZone7::Metal Building
1980_2004::ClimateZone7::SteelFramed
1980_2004::ClimateZone7::WoodFramed
1980_2004::ClimateZone8::Mass
1980_2004::ClimateZone8::Metal Building
1980_2004::ClimateZone8::SteelFramed
1980_2004::ClimateZone8::WoodFramed
2004::ClimateZone1::Mass
2004::ClimateZone1::Metal Building
2004::ClimateZone1::SteelFramed
2004::ClimateZone1::WoodFramed
2004::ClimateZone2::Mass
2004::ClimateZone2::Metal Building
2004::ClimateZone2::SteelFramed
2004::ClimateZone2::WoodFramed
2004::ClimateZone3::Mass
2004::ClimateZone3::Metal Building
2004::ClimateZone3::SteelFramed
2004::ClimateZone3::WoodFramed
2004::ClimateZone4::Mass
2004::ClimateZone4::Metal Building
2004::ClimateZone4::SteelFramed
2004::ClimateZone4::WoodFramed
2004::ClimateZone5::Mass
2004::ClimateZone5::Metal Building
2004::ClimateZone5::SteelFramed
2004::ClimateZone5::WoodFramed
2004::ClimateZone6::Mass
2004::ClimateZone6::Metal Building
2004::ClimateZone6::SteelFramed
2004::ClimateZone6::WoodFramed
2004::ClimateZone7::Mass
2004::ClimateZone7::Metal Building
2004::ClimateZone7::SteelFramed
2004::ClimateZone7::WoodFramed
2004::ClimateZone8::Mass
2004::ClimateZone8::Metal Building
2004::ClimateZone8::SteelFramed
2004::ClimateZone8::WoodFramed
2007::ClimateZone1::Mass
2007::ClimateZone1::Metal Building
2007::ClimateZone1::SteelFramed
2007::ClimateZone1::WoodFramed
2007::ClimateZone2::Mass
2007::ClimateZone2::Metal Building
2007::ClimateZone2::SteelFramed
2007::ClimateZone2::WoodFramed
2007::ClimateZone3::Mass
2007::ClimateZone3::Metal Building
2007::ClimateZone3::SteelFramed
2007::ClimateZone3::WoodFramed
2007::ClimateZone4::Mass
2007::ClimateZone4::Metal Building
2007::ClimateZone4::SteelFramed
2007::ClimateZone4::WoodFramed
2007::ClimateZone5::Mass
2007::ClimateZone5::Metal Building
2007::ClimateZone5::SteelFramed
2007::ClimateZone5::WoodFramed
2007::ClimateZone6::Mass
2007::ClimateZone6::Metal Building
2007::ClimateZone6::SteelFramed
2007::ClimateZone6::WoodFramed
2007::ClimateZone7::Mass
2007::ClimateZone7::Metal Building
2007::ClimateZone7::SteelFramed
2007::ClimateZone7::WoodFramed
2007::ClimateZone8::Mass
2007::ClimateZone8::Metal Building
2007::ClimateZone8::SteelFramed
2007::ClimateZone8::WoodFramed
2010::ClimateZone1::Mass
2010::ClimateZone1::Metal Building
2010::ClimateZone1::SteelFramed
2010::ClimateZone1::WoodFramed
2010::ClimateZone2::Mass
2010::ClimateZone2::Metal Building
2010::ClimateZone2::SteelFramed
2010::ClimateZone2::WoodFramed
2010::ClimateZone3::Mass
2010::ClimateZone3::Metal Building
2010::ClimateZone3::SteelFramed
2010::ClimateZone3::WoodFramed
2010::ClimateZone4::Mass
2010::ClimateZone4::Metal Building
2010::ClimateZone4::SteelFramed
2010::ClimateZone4::WoodFramed
2010::ClimateZone5::Mass
2010::ClimateZone5::Metal Building
2010::ClimateZone5::SteelFramed
2010::ClimateZone5::WoodFramed
2010::ClimateZone6::Mass
2010::ClimateZone6::Metal Building
2010::ClimateZone6::SteelFramed
2010::ClimateZone6::WoodFramed
2010::ClimateZone7::Mass
2010::ClimateZone7::Metal Building
2010::ClimateZone7::SteelFramed
2010::ClimateZone7::WoodFramed
2010::ClimateZone8::Mass
2010::ClimateZone8::Metal Building
2010::ClimateZone8::SteelFramed
2010::ClimateZone8::WoodFramed
2013::ClimateZone1::Mass
2013::ClimateZone1::Metal Building
2013::ClimateZone1::SteelFramed
2013::ClimateZone1::WoodFramed
2013::ClimateZone2::Mass
2013::ClimateZone2::Metal Building
2013::ClimateZone2::SteelFramed
2013::ClimateZone2::WoodFramed
2013::ClimateZone3::Mass
2013::ClimateZone3::Metal Building
2013::ClimateZone3::SteelFramed
2013::ClimateZone3::WoodFramed
2013::ClimateZone4::Mass
2013::ClimateZone4::Metal Building
2013::ClimateZone4::SteelFramed
2013::ClimateZone4::WoodFramed
2013::ClimateZone5::Mass
2013::ClimateZone5::Metal Building
2013::ClimateZone5::SteelFramed
2013::ClimateZone5::WoodFramed
2013::ClimateZone6::Mass
2013::ClimateZone6::Metal Building
2013::ClimateZone6::SteelFramed
2013::ClimateZone6::WoodFramed
2013::ClimateZone7::Mass
2013::ClimateZone7::Metal Building
2013::ClimateZone7::SteelFramed
2013::ClimateZone7::WoodFramed
2013::ClimateZone8::Mass
2013::ClimateZone8::Metal Building
2013::ClimateZone8::SteelFramed
2013::ClimateZone8::WoodFramed
2016::ClimateZone1::Mass
2016::ClimateZone1::Metal Building
2016::ClimateZone1::SteelFramed
2016::ClimateZone1::WoodFramed
2016::ClimateZone2::Mass
2016::ClimateZone2::Metal Building
2016::ClimateZone2::SteelFramed
2016::ClimateZone2::WoodFramed
2016::ClimateZone3::Mass
2016::ClimateZone3::Metal Building
2016::ClimateZone3::SteelFramed
2016::ClimateZone3::WoodFramed
2016::ClimateZone4::Mass
2016::ClimateZone4::Metal Building
2016::ClimateZone4::SteelFramed
2016::ClimateZone4::WoodFramed
2016::ClimateZone5::Mass
2016::ClimateZone5::Metal Building
2016::ClimateZone5::SteelFramed
2016::ClimateZone5::WoodFramed
2016::ClimateZone6::Mass
2016::ClimateZone6::Metal Building
2016::ClimateZone6::SteelFramed
2016::ClimateZone6::WoodFramed
2016::ClimateZone7::Mass
2016::ClimateZone7::Metal Building
2016::ClimateZone7::SteelFramed
2016::ClimateZone7::WoodFramed
2016::ClimateZone8::Mass
2016::ClimateZone8::Metal Building
2016::ClimateZone8::SteelFramed
2016::ClimateZone8::WoodFramed
2019::ClimateZone1::Mass
2019::ClimateZone1::Metal Building
2019::ClimateZone1::SteelFramed
2019::ClimateZone1::WoodFramed
2019::ClimateZone2::Mass
2019::ClimateZone2::Metal Building
2019::ClimateZone2::SteelFramed
2019::ClimateZone2::WoodFramed
2019::ClimateZone3::Mass
2019::ClimateZone3::Metal Building
2019::ClimateZone3::SteelFramed
2019::ClimateZone3::WoodFramed
2019::ClimateZone4::Mass
2019::ClimateZone4::Metal Building
2019::ClimateZone4::SteelFramed
2019::ClimateZone4::WoodFramed
2019::ClimateZone5::Mass
2019::ClimateZone5::Metal Building
2019::ClimateZone5::SteelFramed
2019::ClimateZone5::WoodFramed
2019::ClimateZone6::Mass
2019::ClimateZone6::Metal Building
2019::ClimateZone6::SteelFramed
2019::ClimateZone6::WoodFramed
2019::ClimateZone7::Mass
2019::ClimateZone7::Metal Building
2019::ClimateZone7::SteelFramed
2019::ClimateZone7::WoodFramed
2019::ClimateZone8::Mass
2019::ClimateZone8::Metal Building
2019::ClimateZone8::SteelFramed
2019::ClimateZone8::WoodFramed
Default Generic Construction Set
pre_1980::ClimateZone1::Mass
pre_1980::ClimateZone1::Metal Building
pre_1980::ClimateZone1::SteelFramed
pre_1980::ClimateZone1::WoodFramed
pre_1980::ClimateZone2::Mass
pre_1980::ClimateZone2::Metal Building
pre_1980::ClimateZone2::SteelFramed
pre_1980::ClimateZone2::WoodFramed
pre_1980::ClimateZone3::Mass
pre_1980::ClimateZone3::Metal Building
pre_1980::ClimateZone3::SteelFramed
pre_1980::ClimateZone3::WoodFramed
pre_1980::ClimateZone4::Mass
pre_1980::ClimateZone4::Metal Building
pre_1980::ClimateZone4::SteelFramed
pre_1980::ClimateZone4::WoodFramed
pre_1980::ClimateZone5::Mass
pre_1980::ClimateZone5::Metal Building
pre_1980::ClimateZone5::SteelFramed
pre_1980::ClimateZone5::WoodFramed
pre_1980::ClimateZone6::Mass
pre_1980::ClimateZone6::Metal Building
pre_1980::ClimateZone6::SteelFramed
pre_1980::ClimateZone6::WoodFramed
pre_1980::ClimateZone7::Mass
pre_1980::ClimateZone7::Metal Building
pre_1980::ClimateZone7::SteelFramed
pre_1980::ClimateZone7::WoodFramed
pre_1980::ClimateZone8::Mass
pre_1980::ClimateZone8::Metal Building
pre_1980::ClimateZone8::SteelFramed
pre_1980::ClimateZone8::WoodFramed""")
duplicate_data_2 = DuplicateData(Data=panel_15, Number=list_length_2, Order=True)
list_length_8 = ListLength(List=panel_15)
partition_list_4 = PartitionList(List=duplicate_data_2, Size=list_length_8)  # -> simplify(Chunks)
ui_dropdown_list_2 = UiDropdownList(Values=partition_list_4, Index=0)  # -> simplify(Elements)

ui_label_7 = UiLabel(Label=format)  # -> simplify(graft(Elements))
ui_label_8 = UiLabel(Element=ui_label_7, Style=3)  # -> simplify(graft(Elements))

# UWG Simulation
# Parameters
refepwpar = DFReferenceEPWParameters(obstacle_hght=explode_tree.Branch3, veg_cover=explode_tree.Branch4)  # -> epw_site; plug-in component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
boundarylayer = DFBoundaryLayerParameters()  # -> bnd_layer; plug-in component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
vegetationpar = DFVegetationParameters(albedo=explode_tree.Branch0, tree_latent=explode_tree.Branch1, grass_latent=explode_tree.Branch2)  # -> veg_par; plug-in component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

# ---- group: make EPW 2.0.1 / location csv
concatenate_3 = Concatenate(FragmentA=relative_path, FragmentB="locations.csv")
read_file_2 = ReadFile(File=concatenate_3, PerLineParse=True)
cull_index_3 = CullIndex(List=read_file_2, Indices=0, Wrap=True)
list_item_8 = ListItem(List=read_file_2, Index=0, Wrap=True)
text_split_4 = TextSplit(Text=cull_index_3, Separators=",")  # -> simplify(Result)
text_split_5 = TextSplit(Text=list_item_8, Separators=",")  # -> simplify(Result)
flip_matrix_2 = FlipMatrix(Data=text_split_4)
keys_2 = Panel(text_split_5)
list_length_9 = ListLength(List=keys_2)
locations = ValueList({"id": "0", "lat": "1", "lon": "2", "place": "3"}, selected="lat")
locations_2 = ValueList({"id": "0", "lat": "1", "lon": "2", "place": "3"}, selected="lon")
locations_3 = ValueList({"id": "0", "lat": "1", "lon": "2", "place": "3"}, selected="place")
valuelist_name_3 = Panel("locations")
series_4 = Series(Start=0, Step=1, Count=list_length_9)
csv_values_2 = Text(flip_matrix_2)
values_2 = Text(series_4)
pvl_2 = PopulateValueList(Name=valuelist_name_3, Keys=keys_2, Values=values_2)  # inputs Keys: list, Values: list; same code as pvl
tree_branch_2 = TreeBranch(Tree=csv_values_2, Path=locations, MaintainPaths=True)
tree_branch_3 = TreeBranch(Tree=csv_values_2, Path=locations_2, MaintainPaths=True)
tree_branch_4 = TreeBranch(Tree=csv_values_2, Path=locations_3, MaintainPaths=True)
replace_text_11 = ReplaceText(Text=tree_branch_4, Find="\"", RecursiveReplace=False)
keys_3 = Panel(replace_text_11)
list_length_10 = ListLength(List=keys_3)
valuelist_name_4 = Panel("cities")
series_5 = Series(Start=1, Step=1, Count=list_length_10)
values_3 = Text(series_5)
pvl_3 = PopulateValueList(Name=valuelist_name_4, Keys=keys_3, Values=values_3)  # inputs Keys: list, Values: list; same code as pvl

# ---- group: repday 5.3.3
trigger = Trigger(Interval=60000, TimerInterval=60000, Target=get_groups)  # disabled
get_groups = GetGroups()  # -> Groups, GroupStyles, Nickname, Color
panel_16 = Panel("""input:
logic:
GUI:
output:""")
list_length_11 = ListLength(List=panel_16)  # -> expr("x-1", Length)
match_text_4 = MatchText(Text=get_groups.Nickname, RegEx=graft(panel_16), Case=True)
range_2 = Range(Domain=Domain(0, 1), Steps=list_length_11)
cull_pattern_4 = CullPattern(List=get_groups.Groups, CullPattern=match_text_4)
gradient_5 = Gradient(
    LowerLimit=0,
    UpperLimit=1,
    Parameter=range_2,
    stops=[0: RGB(0, 56, 102), 0.2: RGB(1, 143, 148), 0.4: RGB(51, 189, 90), 0.6: RGB(255, 187, 0), 0.8: RGB(209, 89, 59), 1: RGB(173, 23, 126)])
set_group_properties = SetGroupProperties(Group=cull_pattern_4, Color=graft(gradient_5))
panel_17 = Panel(gradient_5)
ui_spacer_12 = UiSpacer(Width=20, Horizontal=invert(False))
ui_spacer_13 = UiSpacer(Width=20, Horizontal=invert(False))
ui_spacer_14 = UiSpacer(Width=20, Horizontal=invert(False))
colour_swatch = ColourSwatch(SwatchColor=RGB(122, 122, 122))
colour_swatch_2 = ColourSwatch(SwatchColor=RGB(0, 162, 199))
colour_swatch_3 = ColourSwatch(SwatchColor=RGB(186, 15, 112))
document_info = DocumentInfo(AutoUpdate=True, Recursive=True)  # -> DocumentName, DocumentFilePath, Components, Params, _3rdPartyAssemblies
panel_18 = Panel(document_info._3rdPartyAssemblies)

# ----
ui_expander_layout = UiExpanderLayout(Elements=merge_5, Title="Select weather data", Direction=0, Closed=invert(True))

ui_expander_layout_2 = UiExpanderLayout(Elements=merge, Title="Grid", Direction=0, Closed=invert(True))

ui_expander_layout_3 = UiExpanderLayout(Elements=merge_4, Title="Select Analyse", Direction=0, Closed=invert(True))

ui_expander_layout_4 = UiExpanderLayout(Elements=merge_6, Title="Select period", Direction=0, Closed=invert(True))

merge_13 = Merge(Data1=ui_expander_layout, Data2=ui_expander_layout_4, Data3=ui_expander_layout_2, Data4=ui_expander_layout_3)
ui_window = UiWindow(Elements=merge_13, Title="Analyse", Owner=1, Scroll=False, Launch=start_update_analise_blue)
ui_set_graphics = UiSetGraphics(
    Element=ui_window,
    PrimaryColor=RGB(128, 128, 128),
    AccentColor=RGB(128, 128, 128),
    StrokeColor=RGB(128, 128, 128),
    StrokeWeight=0)

list_length_12 = ListLength(List=merge_13)
series_6 = Series(Start=0, Step=1, Count=list_length_12)
list_length_13 = ListLength(List=series_6)  # -> expr("x-1", Length)
remap_numbers = RemapNumbers(Value=series_6, Source=list_length_13, Target=Domain(0, 1))  # -> Mapped, Clipped
gradient_6 = Gradient(LowerLimit=0, UpperLimit=1, Parameter=reverse(remap_numbers.Mapped), stops=[0: RGB(0, 170, 255), 1: RGB(174, 219, 245)])
list_item_9 = ListItem(List=gradient_6, Index=0, Wrap=False)  # -> Item, Item1, Item2, Item3

cluster = Cluster(colour=list_item_9.Item)
cluster_2 = Cluster_2(colour=list_item_9.Item)
cluster_3 = Cluster(colour=list_item_9.Item1)
ui_set_graphics_2 = UiSetGraphics(Element=ui_load_button_2, PrimaryColor=cluster_2, AccentColor=cluster)
cluster_4 = Cluster_2(colour=list_item_9.Item1)
cluster_5 = Cluster(colour=list_item_9.Item3)
cluster_6 = Cluster_2(colour=list_item_9.Item3)
ui_set_graphics_3 = UiSetGraphics(Element=merge_3, PrimaryColor=cluster_4, AccentColor=cluster_3)
ui_set_graphics_4 = UiSetGraphics(Element=ui_button, PrimaryColor=cluster_6, AccentColor=cluster_5)

cluster_7 = Cluster_2(colour=list_item_9.Item2)
ui_set_graphics_5 = UiSetGraphics(Element=ui_expander_layout_2, PrimaryColor=cluster_7, AccentColor=list_item_9.Item2, StrokeColor=list_item_9.Item2)

cluster_8 = Cluster_2(colour=list_item_9.Item3)
ui_set_graphics_6 = UiSetGraphics(Element=ui_expander_layout_3, PrimaryColor=cluster_8, AccentColor=list_item_9.Item3, StrokeColor=list_item_9.Item3)

cluster_9 = Cluster_2(colour=list_item_9.Item)
ui_set_graphics_7 = UiSetGraphics(Element=ui_expander_layout, PrimaryColor=cluster_9, AccentColor=list_item_9.Item, StrokeColor=list_item_9.Item)

cluster_10 = Cluster_2(colour=list_item_9.Item1)
ui_set_graphics_8 = UiSetGraphics(Element=ui_expander_layout_4, PrimaryColor=cluster_10, AccentColor=list_item_9.Item1, StrokeColor=list_item_9.Item1)

# ---- group: UWG morphing 1.0.0
dynamic_geometry_pipeline_3 = DynamicGeometryPipeline(
    LayerFilter=cull_pattern,
    TypeFilter="Brep",
    NameFilter="*",
    GroupByLayer=False,
    GroupByType=False,
    IncludeHidden=True,
    IncludeLocked=True,
    enableFullPath=False,
    listenToAttributes=True)
list_item_10 = ListItem(List=replace_text_3, Index=0, Wrap=True)
list_item_11 = ListItem(List=replace_text_2, Index=0, Wrap=True)
format_8 = Format(Format="There are no contex into layer \"{0}\"", Culture=127, Data0=list_item_10)
format_9 = Format(Format="The context is loaded into layer \"{0}\"", Culture=127, Data0=list_item_10)
ui_slider_8 = UiSlider(Label="Tree cover", Value=0.5, Bounds=Domain(0, 1), Increment=0.1)
ui_slider_9 = UiSlider(Label="Grass cover", Value=0.5, Bounds=Domain(0, 1), Increment=0.1)
ui_toggle = UiToggle(Label="Use Contex shades as tree cover", State=True)
ui_label_9 = UiLabel(Label="Use Contex shades as tree cover")
merge_14 = Merge(Data1=ui_toggle, Data2=ui_slider_8, Data3=ui_slider_9, Data4=ui_label_9)

# ----
cull_pattern_5 = CullPattern(List=dynamic_geometry_pipeline_3, CullPattern=list_length_5)

# ---- group: UWG morphing 1.0.0 (continued)
list_length_14 = ListLength(List=cull_pattern_5)
larger_than = LargerThan(FirstNumber=list_length_14, SecondNumber=0)  # -> LargerThan, OrEqualTo
stream_filter_3 = StreamFilter(Gate=larger_than.LargerThan, Stream0=format_8, Stream1=format_9)
ui_label_10 = UiLabel(Element=ui_label_9, Label=stream_filter_3, Style=3)

# ----
merge_15 = Merge(Data1=dynamic_geometry_pipeline, Data2=dynamic_geometry_pipeline_2, Data3=cull_pattern_5)

your_geometry = Geometry(flatten([dynamic_geometry_pipeline, dynamic_geometry_pipeline_2]))
your_context = Geometry(flatten(cull_pattern_5))

# ----
# insert here
# a rectangle
your_context_2 = Geometry(flatten(merge_15))
volume_2 = Volume(Geometry=your_geometry)  # -> Volume, Centroid
larger_than_2 = LargerThan(FirstNumber=volume_2.Volume, SecondNumber=9)  # -> LargerThan, OrEqualTo
cull_pattern_6 = CullPattern(List=your_geometry, CullPattern=larger_than_2.LargerThan)
dispatch = Dispatch(List=your_geometry, DispatchPattern=volume_2.Volume)  # -> ListA, ListB
extrude = Extrude(Base=dispatch.ListB, Direction=Vector(0, 0, -1))
directsunhours = LBDirectSunHours(
    vectors=flatten(sunpath.vectors),
    geometry=flatten(your_geometry),
    context=flatten(your_context),
    grid_size=ui_values_3,
    legend_par=legendpar_2,
    run=list_item.Item)  # -> out, points, results, flatten(mesh), flatten(legend), flatten(title), int_mtx; plug-in component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
incidentradiation = LBIncidentRadiation(
    sky_mtx=skymatrix.sky_mtx,
    geometry=flatten([cull_pattern_6, extrude]),
    context=flatten(your_context),
    grid_size=ui_values_3,
    irradiance=True,
    legend_par=legendpar,
    run=list_item.Item1)  # -> out, points, results, total, mesh, legend, title, int_mtx; plug-in component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
bounding_box_2 = BoundingBox(Content=[your_geometry, your_context], Plane=PlaneXY(0, 0, 0), UnionBox=True)  # -> Box, Box_2
deconstruct_brep = DeconstructBrep(Brep=bounding_box_2.Box)  # -> Faces, Edges, Vertices
list_item_12 = ListItem(List=deconstruct_brep.Faces, Index=0, Wrap=True)  # -> Item2, Item1, Item
parameter_point_on_surface = ParameterPointOnSurface(Surface=list_item_12.Item2, ParameterU=ui_values_4, ParameterV=ui_values_5)  # -> Point, Normal
circle = Circle(Plane=parameter_point_on_surface.Point, Radius=ui_values_6)

number_slider_2 = Slider(1.5, range=0..10)
uci_area = Geometry(circle)

boundary_surfaces = BoundarySurfaces(Edges=uci_area)
genpts = LBGeneratePointGrid(geometry=boundary_surfaces, grid_size=ui_values_3)  # -> points, vectors, face_areas, mesh; plug-in component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
humantosky = LBHumanToSkyRelation(
    location=importepw.location,
    position=flatten(genpts.points),
    context=flatten(your_context_2),
    height=number_slider_2,
    run=list_item.Item2)  # -> out, human_points, human_line, fract_body_exp, sky_exposure; plug-in component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
applyper_8 = LBApplyAnalysisPeriod(data=humantosky.fract_body_exp, period=analysisperiod_2.period)  # -> data; plug-in component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
outdoorsolarmrt = LBOutdoorSolarMRT(
    location=importepw.location,
    surface_temp=list_item_2,
    dir_norm_rad=applyper_2,
    diff_horiz_rad=applyper_3,
    horiz_infrared=applyper_4,
    fract_body_exp=applyper_8,
    sky_exposure=humantosky.sky_exposure,
    run=True)  # -> out, short_erf, long_erf, short_dmrt, long_dmrt, mrt; plug-in component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
utci_3 = LBUTCIComfort(air_temp=applyper_5, mrt=outdoorsolarmrt.mrt, rel_humid=applyper_6, wind_vel=applyper_7, run=list_item.Item2)  # -> out, utci, comfort, condition, category, comf_obj; plug-in component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
xdata_4 = LBDeconstructData(data=utci_3.utci)  # -> header, flatten(values); plug-in component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
unit_z = UnitZ(Factor=number_slider_2)
list_length_15 = ListLength(List=flatten([incidentradiation.mesh, incidentradiation.legend, incidentradiation.title]))
list_length_16 = ListLength(List=flatten([directsunhours.mesh, directsunhours.title, directsunhours.legend]))
box_corners_2 = BoxCorners(Box=bounding_box_2.Box)  # -> CornerA, CornerB, CornerC, CornerD, CornerE, CornerF, CornerG, CornerH
larger_than_3 = LargerThan(FirstNumber=list_length_15, SecondNumber=3)  # -> LargerThan, OrEqualTo
larger_than_4 = LargerThan(FirstNumber=list_length_16, SecondNumber=3)  # -> LargerThan, OrEqualTo
move = Move(Geometry=flatten(genpts.mesh), Motion=unit_z)  # -> Geometry, Transform
distance = Distance(PointA=box_corners_2.CornerA, PointB=box_corners_2.CornerB)  # -> expr("-(x*1.1)-(x*1.1)/2", Distance)
dispatch_2 = Dispatch(
    List=[incidentradiation.mesh, incidentradiation.legend, incidentradiation.title],
    DispatchPattern=larger_than_3.LargerThan)  # -> ListA, ListB
dispatch_3 = Dispatch(List=[directsunhours.mesh, directsunhours.title, directsunhours.legend], DispatchPattern=larger_than_4.LargerThan)  # -> ListA, ListB
unit_x = UnitX(Factor=distance)
data_recorder_2 = DataRecorder(flatten(dispatch_2.ListA), DataLimit=15, RecordData=True)
data_recorder_3 = DataRecorder(flatten(dispatch_3.ListA), DataLimit=15, RecordData=True)
heatmap = LBSpatialHeatmap(values=xdata_4.values, mesh=move.Geometry, legend_par=legendpar_3)  # -> mesh, legend, title, colors, legend_par; plug-in component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
distance_2 = Distance(PointA=box_corners_2.CornerA, PointB=box_corners_2.CornerB)  # -> expr("-2.5*(x*1.1)-(x*1.1)/2", Distance)
list_length_17 = ListLength(List=flatten([heatmap.mesh, heatmap.legend, heatmap.title]))
move_2 = Move(Geometry=flatten(data_recorder_3), Motion=unit_x)  # -> Geometry, Transform
unit_x_2 = UnitX(Factor=distance_2)
larger_than_5 = LargerThan(FirstNumber=list_length_17, SecondNumber=3)  # -> LargerThan, OrEqualTo
dispatch_4 = Dispatch(List=[heatmap.mesh, heatmap.legend, heatmap.title], DispatchPattern=larger_than_5.LargerThan)  # -> ListA, ListB
move_3 = Move(Geometry=flatten(data_recorder_2), Motion=unit_x_2)  # -> Geometry, Transform
data_recorder_4 = DataRecorder(flatten(dispatch_4.ListA), DataLimit=15, RecordData=True)
unit_z_2 = UnitZ(Factor=number_slider_2)
move_4 = Move(Geometry=flatten(data_recorder_4), Motion=unit_z_2)  # -> Geometry, Transform

# ---- group: repday 5.3.3 / GUI: Database
panel_19 = Panel("The Database is loaded when the program is opened. You must have the Excel app installed. It is preferable not to close the database because sometimes it breaks you will need to rebuild it. If you happen to close the Database you can reload it with the reload button.")
cities = Text(get_cities_from_coordinates.cities_3)
ui_button_2 = UiButton(Label=cities)  # -> flatten(Elements)
ui_text_block = UiTextBlock(Text="The Database contains data from Alba Adriatica-38688, Alba Adriatica, San Benedetto del Tronto and Ancon")  # -> flatten(Elements)
ui_button_3 = UiButton(Label="Reload database")  # -> flatten(Elements)
ui_text_block_2 = UiTextBlock(Text=panel_19)  # -> flatten(Elements)
ui_values_14 = UiValues(Element=ui_button_2)  # -> flatten(Values)
member_index = MemberIndex(Set=ui_values_14, Member=True)  # -> Index, Count

# ---- group: repday 5.3.3 / logic: selectet Variable and remove 29-02
format_10 = Panel("0.00")
selectet_variable_and_remove_29_02 = SelectetVariableAndRemove2902(
    run=canrun,
    weather_data_1hr_path=make_directory_paths.weather_data_1hr_path_2,
    cities=get_cities_from_coordinates.cities_3,
    city_index=member_index.Index,
    format=format_10)  # -> worksheet_2, selected_labels_2, selected_data_2, format_5

# ---- group: repday 5.3.3 / output: load and rebuild database
activate_worksheet = ActivateWorksheet(Worksheet=selectet_variable_and_remove_29_02.worksheet_2)
concatenate_4 = Concatenate(Fragment_A=make_directory_paths.ghfilepath_3, Fragment_B=make_directory_paths.db_workbook_4, A=".xlsx")
load_workbook = LoadWorkbook(ExcelApplication=activate_worksheet, FilePath=concatenate_4)
activate_workbook = ActivateWorkbook(Workbook=load_workbook)
list_length_18 = ListLength(List=activate_workbook)
compile_row = CompileRow(
    ColumnNames=selectet_variable_and_remove_29_02.selected_labels_2,
    ColumnValues=selectet_variable_and_remove_29_02.selected_data_2,
    Format=selectet_variable_and_remove_29_02.format_5)  # -> flatten(DataSet)
stream_filter_4 = StreamFilter(Gate=list_length_18, Stream1=selectet_variable_and_remove_29_02.worksheet_2)
activate_worksheet_2 = ActivateWorksheet(Worksheet=stream_filter_4)
write_data = WriteData(Worksheet=activate_worksheet_2, Cell="a1", DataSet=compile_row, Clear=True, Activate=True)  # -> Worksheet, Range
save_workbook = SaveWorkbook(
    Workbook=write_data.Worksheet,
    FolderPath=make_directory_paths.ghfilepath_3,
    FileName=make_directory_paths.db_workbook_4,
    Extensions=0,
    Activate=invert(False))  # -> Workbook, FilePath

# ---- group: repday 5.3.3 / logic: extract RD LRD and Ck
get_worksheets = GetWorksheets(Workbook=activate_workbook)
match_text_5 = MatchText(Text=get_worksheets, RegEx="-", Case=True)
cull_pattern_7 = CullPattern(List=get_worksheets, CullPattern=match_text_5)
sort_text = SortText(Keys=cull_pattern_7, Values=cull_pattern_7, Culture=127)  # -> Keys, Values
active_range = ActiveRange(Worksheet=sort_text.Values)
replace_text_12 = ReplaceText(Text=active_range, Find="A1", Replace="A4", RecursiveReplace=False)
replace_text_13 = ReplaceText(Text=replace_text_12, Find="H", Replace="B", RecursiveReplace=False)
sort_text_2 = SortText(Keys=sort_text.Values, Values=sort_text.Values, Culture=127)  # -> Keys, Values
read_data = ReadData(Worksheet=sort_text_2.Values, Range=replace_text_13, Activate=True)  # -> Range, Data
partition_list_5 = PartitionList(List=read_data.Data, Size=2)
list_item_13 = ListItem(List=partition_list_5, Index=0, Wrap=True)  # -> flatten(Item), flatten(Item1)
text_length = TextLength(Text=list_item_13.Item)
larger_than_6 = LargerThan(FirstNumber=text_length, SecondNumber=0)  # -> LargerThan, OrEqualTo
cull_pattern_8 = CullPattern(List=list_item_13.Item1, CullPattern=larger_than_6.LargerThan)
cull_pattern_9 = CullPattern(List=list_item_13.Item, CullPattern=larger_than_6.LargerThan)
create_set = CreateSet(List=cull_pattern_9)  # -> Set, Map
assignpaths = AssignPaths(InputData=flatten(cull_pattern_8), PathsToAssign=flatten(create_set.Map))
read_data_2 = ReadData(Worksheet=sort_text.Values, Range="F4:F27", Activate=True)  # -> Range, Data
read_data_3 = ReadData(Worksheet=sort_text.Values, Range="A4:A27", Activate=True)  # -> Range, Data
list_item_14 = ListItem(
    List=reverse(assignpaths),
    Index=[0, 1, 2, 3, 4, 5, 6, 7, 8, 9, 10, 11, 12, 13, 14, 15, 16, 17, 18, 19, 20, 21, 22, 23],
    Wrap=True)  # -> reverse(simplify(Item))
list_item_15 = ListItem(
    List=assignpaths,
    Index=[0, 1, 2, 3, 4, 5, 6, 7, 8, 9, 10, 11, 12, 13, 14, 15, 16, 17, 18, 19, 20, 21, 22, 23],
    Wrap=True)  # -> simplify(Item)
sort_text_3 = SortText(Keys=read_data_3.Data, Values=read_data_2.Data, Culture=127)  # -> Keys, Values
merge_16 = Merge(Data1=list_item_15, Data2=list_item_14)  # -> simplify(Result)
flip_matrix_3 = FlipMatrix(Data=sort_text_3.Values)  # -> simplify(Data)
number = Number(merge_16)
number_2 = Number(flip_matrix_3)
merge_17 = Merge(Data1=number, Data2=number_2)

# ---- group: repday 5.3.3
replace_text_14 = ReplaceText(Text=active_range, Find="A1", Replace="C4", RecursiveReplace=False)
replace_text_15 = ReplaceText(Text=active_range, Find="A1", Replace="E4", RecursiveReplace=False)
replace_text_16 = ReplaceText(Text=active_range, Find="A1", Replace="A4", RecursiveReplace=False)
replace_text_17 = ReplaceText(Text=replace_text_14, Find="H", Replace="C", RecursiveReplace=False)
replace_text_18 = ReplaceText(Text=replace_text_15, Find="H", Replace="E", RecursiveReplace=False)
replace_text_19 = ReplaceText(Text=replace_text_16, Find="H", Replace="A", RecursiveReplace=False)
read_data_4 = ReadData(Worksheet=sort_text.Values, Range=replace_text_17, Activate=True)  # -> Range, Data
read_data_5 = ReadData(Worksheet=sort_text.Values, Range=replace_text_18, Activate=True)  # -> Range, Data
read_data_6 = ReadData(Worksheet=sort_text.Values, Range=replace_text_19, Activate=True)  # -> Range, Data
text_length_2 = TextLength(Text=read_data_6.Data)
cull_pattern_10 = CullPattern(List=read_data_4.Data, CullPattern=text_length_2)
cull_pattern_11 = CullPattern(List=read_data_5.Data, CullPattern=text_length_2)
cull_pattern_12 = CullPattern(List=read_data_6.Data, CullPattern=text_length_2)
text_length_3 = TextLength(Text=cull_pattern_10)  # -> expr("x-1", Length)
text_length_4 = TextLength(Text=cull_pattern_11)  # -> expr("x-1", Length)
cull_pattern_13 = CullPattern(List=cull_pattern_10, CullPattern=text_length_3)
cull_pattern_14 = CullPattern(List=cull_pattern_11, CullPattern=text_length_4)
cull_pattern_15 = CullPattern(List=cull_pattern_12, CullPattern=text_length_3)
clean_tree = CleanTree(RemoveNulls=True, RemoveInvalid=True, RemoveEmpty=True, Tree=cull_pattern_13)
clean_tree_2 = CleanTree(RemoveNulls=True, RemoveInvalid=True, RemoveEmpty=True, Tree=cull_pattern_14)
clean_tree_3 = CleanTree(RemoveNulls=True, RemoveInvalid=True, RemoveEmpty=True, Tree=cull_pattern_15)
create_set_2 = CreateSet(List=flatten(clean_tree_3))  # -> Set, Map
unflatten_tree = UnflattenTree(Tree=create_set_2.Map, Guide=clean_tree_3)
assignpaths_2 = AssignPaths(InputData=flatten(clean_tree_2), PathsToAssign=flatten(unflatten_tree))
assignpaths_3 = AssignPaths(InputData=flatten(clean_tree_3), PathsToAssign=flatten(unflatten_tree))
assignpaths_4 = AssignPaths(InputData=flatten(clean_tree), PathsToAssign=flatten(unflatten_tree))

# ---- group: repday 5.3.3 / logic: show only a chart
format_11 = Format(Format="Make {0} results chart", Culture=127, Data0=cities)
ui_button_4 = UiButton(Label="Update results")  # -> flatten(Elements)
ui_spacer_15 = UiSpacer(Width=20, Horizontal=False)
ui_button_5 = UiButton(Label=format_11)  # -> flatten(Elements)
ui_values_15 = UiValues(Element=ui_button_4)  # -> flatten(Values)
ui_values_16 = UiValues(Element=ui_button_5)  # -> flatten(Values)
panel_20 = Panel(ui_values_16)
member_index_2 = MemberIndex(Set=ui_values_16, Member=True)  # -> Index, Count
data_recorder_5 = DataRecorder(member_index_2.Index, DataLimit=1, RecordData=True)
path_mapper = PathMapper(merge_17, source=["{A;B}", "{A}"], target=["{A}", "{A}"])
tree_branch_5 = TreeBranch(Tree=simplify(path_mapper), Path=data_recorder_5, MaintainPaths=True)
list_length_19 = ListLength(List=tree_branch_5)
larger_than_7 = LargerThan(FirstNumber=list_length_19, SecondNumber=0)  # -> LargerThan, OrEqualTo
stream_filter_5 = StreamFilter(Gate=larger_than_7.LargerThan, Stream0="0", Stream1=tree_branch_5)
partition_list_6 = PartitionList(List=stream_filter_5, Size=24)  # -> simplify(Chunks)

# ---- group: repday 5.3.3 / logic: update results list
gate_not = GateNot(A=ui_values_15)
enable_disable_object = EnableDisableObject(Enabled=gate_not, AllObjects_Object=get_worksheets)

# ---- group: repday 5.3.3 / output: make chart
read_data_7 = ReadData(Worksheet=sort_text.Values, Range="H2:H3", Activate=True)  # -> Range, Data
read_data_8 = ReadData(Worksheet=sort_text.Values, Range="G2:G3", Activate=True)  # -> Range, Data
explode_tree_2 = ExplodeTree(Data=read_data_8.Data)  # -> Branch0, Branch1
explode_tree_3 = ExplodeTree(Data=read_data_7.Data)  # -> Branch0, Branch1
sort_text_4 = SortText(Keys=sort_text.Values, Values=explode_tree_2.Branch0, Culture=127)  # -> Keys, Values
sort_text_5 = SortText(Keys=sort_text.Values, Values=explode_tree_3.Branch0, Culture=127)  # -> Keys, Values
panel_21 = Panel("""RD {0}
LRD {1}
Ck""")
list_item_16 = ListItem(List=sort_text_4.Values, Index=data_recorder_5, Wrap=True)
list_item_17 = ListItem(List=sort_text_5.Values, Index=data_recorder_5, Wrap=True)
format_12 = Format(Format=panel_21, Culture=127, Data0=list_item_16, Data1=list_item_17)
read_data_9 = ReadData(Worksheet=sort_text.Values, Range="D2:F2", Activate=True)  # -> Range, Data
partition_list_7 = PartitionList(List=read_data_9.Data, Size=3)  # -> simplify(Chunks)
text_join_2 = TextJoin(Text=partition_list_7, Join=" ")  # -> flatten(Result)
text_case = TextCase(Text=text_join_2, Culture=127)  # -> UpperCase, LowerCase
merge_18 = Merge(
    Data1=flatten([0, 1, 2, 3, 4, 5, 6, 7, 8, 9, 10, 11, 12, 13, 14, 15, 16, 17, 18, 19, 20, 21, 22, 23]),
    Data2=flatten(partition_list_6))
panel_22 = Panel("""Hours
RD values
LRD values
Ck values""")
sort_text_6 = SortText(Keys=sort_text.Values, Values=text_case.UpperCase, Culture=127)  # -> Keys, Values
partition_list_8 = PartitionList(List=merge_18, Size=24)
list_item_18 = ListItem(List=sort_text_6.Values, Index=data_recorder_5, Wrap=True)
list_item_19 = ListItem(List=cities, Index=data_recorder_5, Wrap=True)
ui_data_series = UIDataSeries(Label=graft(panel_22), Data=partition_list_8, Type=5)  # -> flatten(DataSeries)
replace_text_20 = ReplaceText(Text=list_item_18, Find="  ", Replace=" ", RecursiveReplace=False)
ui_line_chart = UiLineChart(Horizontal=True, Smoothness=0.5)  # -> flatten(Elements)
ui_data_series_2 = UIDataSeries(Label=graft(format_12), Data=partition_list_6, Type=2)  # -> flatten(DataSeries)
text_case_2 = TextCase(Text=list_item_19, Culture=127)  # -> UpperCase, LowerCase
series_7 = Series(Start=1, Step=1, Count=3)
ui_grid_chart = UiGridChart(Titles=True)
format_13 = Format(Format="{0} - {1}", Culture=127, Data0=text_case_2.UpperCase, Data1=replace_text_20)
ui_data_series_graphics = UiDataSeriesGraphics(
    DataSeries=ui_data_series_2,
    PrimaryColor=[colour_swatch_2, colour_swatch_3, colour_swatch],
    AccentColor=RGBA(173, 23, 126, 0),
    Weight=1.5,
    Marker=series_7)
ui_grid_chart_2 = UiGridChart(Element=ui_grid_chart, DataSeries=ui_data_series, Titles=True)
ui_modify_chart = UiModifyChart(ChartElement=ui_line_chart, XAxisTitle="TIME", YAxisTitle=format_13, LegendLocation=2, Format=2, ShowSeries=True)
ui_line_chart_2 = UiLineChart(Element=ui_modify_chart, DataSeries=ui_data_series_graphics, Horizontal=True, Smoothness=0.5)  # -> flatten(Elements)

# ---- group: repday 5.3.3 / GUI:
ui_spacer_16 = UiSpacer(Width=50, Horizontal=True)
ui_spacer_17 = UiSpacer(Width=50, Horizontal=True)
merge_19 = Merge(
    Data1=ui_button_4,
    Data2=ui_spacer_15,
    Data4=ui_button_5,
    Data5=ui_spacer_16,
    Data6=ui_line_chart,
    Data7=ui_spacer_17,
    Data8=ui_grid_chart)
ui_stack_layout = UiStackLayout(Elements=merge_19, Horizontal=False)

# ---- group: repday 5.3.3 / logic: what is in database
get_worksheets_2 = GetWorksheets(Workbook=activate_workbook)
sort_text_7 = SortText(Keys=get_worksheets_2, Values=get_worksheets_2, Culture=127)  # -> Keys, Values
replace_text_21 = ReplaceText(Text=sort_text_7.Values, Find="Worksheet | ", RecursiveReplace=False)
member_index_3 = MemberIndex(Set=replace_text_21, Member="Foglio1")  # -> Index, Count
member_index_4 = MemberIndex(Set=replace_text_21, Member="Sheet1")  # -> Index, Count
cull_index_4 = CullIndex(List=replace_text_21, Indices=member_index_3.Index, Wrap=True)
cull_index_5 = CullIndex(List=cull_index_4, Indices=member_index_4.Index, Wrap=True)

# ---- group: repday 5.3.3 (continued)
match_text_6 = MatchText(Text=cull_index_5, RegEx="#", Case=True)
cull_pattern_16 = CullPattern(List=cull_index_5, CullPattern=match_text_6)
merge_20 = Merge(
    Data1=ui_button_2,
    Data2=ui_spacer_12,
    Data3=ui_text_block,
    Data4=ui_spacer_13,
    Data5=ui_button_3,
    Data6=ui_spacer_14,
    Data7=ui_text_block_2)
panel_23 = Panel(create_set.Set)

# ---- group: repday 5.3.3 / GUI: Database (continued)
ui_expander_layout_5 = UiExpanderLayout(Elements=merge_20, Title="Build the Database for these locations:", Direction=0, Closed=invert(True))  # -> flatten(Element)

# ---- group: repday 5.3.3 / logic: what is in database (continued)
text_split_6 = TextSplit(Text=cull_pattern_16, Separators="#")
list_length_20 = ListLength(List=cull_pattern_16)
list_item_20 = ListItem(List=text_split_6, Index=0, Wrap=True)  # -> flatten(Item), flatten(Item1)
entwine_2 = Entwine(Branch00=concatenate_4, Branch01=list_length_20, FlattenInputs=True)  # -> flatten(Result)
list_item_21 = ListItem(List=entwine_2, Index=0, Wrap=True)
file_or_directory_exists = FileOrDirectoryExists(Path=list_item_21)
cull_index_6 = CullIndex(List=reverse(list_item_20.Item), Indices=0, Wrap=True)  # -> reverse(List)
list_item_22 = ListItem(List=reverse(list_item_20.Item), Index=0, Wrap=True)
text_join_3 = TextJoin(Text=cull_index_6, Join=", ")

# ---- group: repday 5.3.3 / logic: read labels
list_item_23 = ListItem(List=cull_pattern_16, Index=0, Wrap=True)
range_extents = RangeExtents(Worksheet=list_item_23)  # -> Range, MinCell, MaxCell
list_item_24 = ListItem(List=list_item_20.Item1, Index=0, Wrap=True)
replace_text_22 = ReplaceText(Text=range_extents.MaxCell, Find=list_item_24, RecursiveReplace=False)
concatenate_5 = Concatenate(FragmentA=replace_text_22, FragmentB="1")
concatenate_6 = Concatenate(FragmentA="C1", FragmentB=concatenate_5, JoinSeparator=":")
read_data_10 = ReadData(Worksheet=list_item_23, Range=concatenate_6, Activate=invert(False))  # -> Range, Data

# ---- group: repday 5.3.3 / logic: extract times
list_item_25 = ListItem(List=list_item_20.Item1, Index=0, Wrap=True)
subtraction = Subtraction(A=list_item_25, B="23")
list_item_26 = ListItem(List=cull_pattern_16, Index=0, Wrap=True)
format_14 = Format(Format="B2:B{0}", Culture=127, Data0=subtraction)
read_data_11 = ReadData(Worksheet=list_item_26, Range=format_14, Activate=True)  # -> Range, flatten(Data)
list_item_27 = ListItem(List=read_data_11.Data, Index=0, Wrap=True)  # -> Item1, Item
deconstruct_date_3 = DeconstructDate(Date=list_item_27.Item1)  # -> Year, Month, Day, Hour, Minute, Second
deconstruct_date_4 = DeconstructDate(Date=list_item_27.Item)  # -> Year, Month, Day, Hour, Minute, Second
construct_exotic_date = ConstructExoticDate(Year=deconstruct_date_3.Year, Month=deconstruct_date_3.Month, Day=deconstruct_date_3.Day, Calendar=0)
construct_exotic_date_2 = ConstructExoticDate(Year=deconstruct_date_4.Year, Month=deconstruct_date_4.Month, Day=deconstruct_date_4.Day, Calendar=0)

# ---- group: repday 5.3.3 (continued)
ghpython_script = GhPythonScript(Exists=file_or_directory_exists, Locations=list_length_20)  # -> out, Format
# ---------- ghpython_script: Python ----------
__author__ = "ionon"
__version__ = "2022.12.27"

import rhinoscriptsyntax as rs
if Exists:
    Format="The Database contains data from {0} and {1}"
    if Locations==1:
        Format="The Database contains data only from {1}"
else:
    Format="Please build the database first"
# ---------- end ghpython_script ----------
concatenate_7 = Concatenate(FragmentA=range_extents.MinCell, FragmentB=range_extents.MaxCell, JoinSeparator=":")
read_data_12 = ReadData(Worksheet=list_item_23, Range="A1:A2", Activate=invert(False))  # -> Range, Data

# ---- group: repday 5.3.3 / logic: what is in database (continued)
format_15 = Format(Format=ghpython_script.Format, Culture=127, Data0=text_join_3, Data1=list_item_22)

# ---- group: make EPW 2.0.1
# Resti di stucco:
# questo è un barbatrucco!
get_objects_in_group = GetObjectsInGroup()
match_text_7 = MatchText(Text=get_objects_in_group, RegEx="expander", Case=False)
cull_pattern_17 = CullPattern(List=get_objects_in_group, CullPattern=match_text_7)
list_length_21 = ListLength(List=cull_pattern_17)
series_8 = Series(Start=0, Step=1, Count=list_length_21)
ui_button_6 = UiButton(Label="Ok")
ui_button_7 = UiButton(Label="Open map")
ui_text_box = UiTextBox(
    Text="https://energyplus-weather.s3.amazonaws.com/europe_wmo_region_6/ITA/ITA_Pescara.162300_IGDG/ITA_Pescara.162300_IGDG.zip",
    Wrap=True)
ui_list_box = UiListBox(Values="city")
ui_list_box_2 = UiListBox(Values="year")
ui_values_17 = UiValues(Element=ui_list_box)
ui_values_18 = UiValues(Element=ui_list_box_2)
ui_list_box_3 = UiListBox(Element=ui_list_box, Values=keys_3)
addition = Addition(A=ui_values_17, B=1)
ui_values_19 = UiValues(Element=ui_text_box)
ui_stack_layout_2 = UiStackLayout(Elements=[ui_button_7, ui_text_box], Horizontal=False)
entwine_3 = Entwine(Branch00=ui_text_box, Branch01=ui_text_box, Branch02=ui_list_box_2, FlattenInputs=True)
ui_values_20 = UiValues(Element=ui_button_7)
ui_align_6 = UiAlign(Element=[ui_button_7, ui_text_box], Alignment=3)
ui_align_7 = UiAlign(Element=ui_button_6, Alignment=3)
epwmap = LBEPWmap(epw_map=ui_values_20)  # -> Output; plug-in component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
start_makeepw_green = Button()
ui_values_21 = UiValues(Element=ui_button_6)

# ---- group: make EPW 2.0.1 / 1hr csv (continued)
match_text_8 = MatchText(Text=tree_branch, Pattern=addition, Case=True)
cull_pattern_18 = CullPattern(List=csv_values, CullPattern=match_text_8)  # -> simplify(List)
tree_branch_6 = TreeBranch(Tree=cull_pattern_18, Path=csv_2, MaintainPaths=True)
text_fragment = TextFragment(Text=tree_branch_6, Start=0, Count=4)
create_set_3 = CreateSet(List=text_fragment)  # -> Set, Map
create_set_4 = CreateSet(List=create_set_3.Map)  # -> Set, Map
member_index_5 = MemberIndex(Set=create_set_3.Map, Member=create_set_4.Set)  # -> Index, Count
larger_than_8 = LargerThan(FirstNumber=member_index_5.Count, SecondNumber=8760)  # -> LargerThan, OrEqualTo
cull_pattern_19 = CullPattern(List=create_set_3.Set, CullPattern=larger_than_8.OrEqualTo)
keys_4 = Panel(cull_pattern_19)
pvl_4 = PopulateValueList(Name=valuelist_name_2, Keys=keys_4, Values=keys_4)  # inputs Keys: list, Values: list; same code as pvl

# ---- group: make EPW 2.0.1 / carica epw di base
panel_24 = Panel(ui_values_19)
downloadepw = LBDownloadWeather(weather_URL=panel_24)  # -> epw_file, stat_file, ddy_file; plug-in component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
importepw_4 = LBImportEPW(epw_file=downloadepw.epw_file)  # -> location, dry_bulb_temperature, dew_point_temperature, relative_humidity, wind_speed, wind_direction, direct_normal_rad, diffuse_horizontal_rad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; plug-in component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

# ---- group: make EPW 2.0.1 / location csv (continued)
list_item_28 = ListItem(List=tree_branch_3, Index=expr("x-1", addition), Wrap=True)
list_item_29 = ListItem(List=tree_branch_2, Index=expr("x-1", addition), Wrap=True)
list_item_30 = ListItem(List=keys_3, Index=expr("x-1", addition), Wrap=True)

# ---- group: make EPW 2.0.1
list_length_22 = ListLength(List=series_8)  # -> expr("x-1", Length)
remap_numbers_2 = RemapNumbers(Value=series_8, Source=list_length_22, Target=Domain(0, 1))  # -> Mapped, Clipped
gradient_7 = Gradient(LowerLimit=0, UpperLimit=1, Parameter=remap_numbers_2.Mapped, stops=[0: RGB(218, 237, 147), 1: RGB(24, 120, 101)])

ui_spacer_18 = UiSpacer(Width=20, Horizontal=invert(False))
merge_21 = Merge(Data2=ui_button_6, Data4=ui_spacer_18)
ui_expander_layout_6 = UiExpanderLayout(Elements=merge_21, Title="Save the EPW", Direction=0, Closed=invert(False))

ui_spacer_19 = UiSpacer(Width=20, Horizontal=invert(False))
merge_22 = Merge(Data2=ui_list_box_2, Data4=ui_spacer_19)
ui_expander_layout_7 = UiExpanderLayout(Elements=merge_22, Title="Select the year for EPW making", Direction=0, Closed=invert(False))

ui_spacer_20 = UiSpacer(Width=20, Horizontal=invert(False))
merge_23 = Merge(Data1=ui_stack_layout_2, Data3=ui_spacer_20)
ui_expander_layout_8 = UiExpanderLayout(Elements=merge_23, Title="Open ladybug map", Direction=0, Closed=invert(False))

ui_spacer_21 = UiSpacer(Width=20, Horizontal=invert(False))
merge_24 = Merge(Data1=ui_list_box, Data4=ui_spacer_21)
ui_expander_layout_9 = UiExpanderLayout(Elements=merge_24, Title="Select the city for EPW making", Direction=0, Closed=invert(False))

# ----
replace_text_23 = ReplaceText(Text=list_item_30, Find="Χρυσελεούσα", Replace="Nicosia", RecursiveReplace=False)

# ---- group: make EPW 2.0.1 (continued)
xdata_5 = LBDeconstructData(data=importepw_4.model_year)  # -> header, values; plug-in component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
ui_list_box_4 = UiListBox(Element=ui_list_box_2, Values=keys_4)
list_item_31 = ListItem(List=keys_4, Index=ui_values_18, Wrap=False)
longest_list_3 = LongestList(ListListA=xdata_5.values, ListListB=list_item_31, PaddingMode=2)  # -> ListListA, ListListB
data_2 = LBConstructData(header=xdata_5.header, values=longest_list_3.ListListB)  # -> data; plug-in component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
cluster_11 = Cluster_2(colour=gradient_7)
ui_set_graphics_9 = UiSetGraphics(Element=entwine_3, PrimaryColor=graft(cluster_11))
merge_25 = Merge(
    Data1=flatten(ui_expander_layout_8),
    Data2=flatten(ui_expander_layout_9),
    Data3=flatten(ui_expander_layout_7),
    Data4=flatten(ui_expander_layout_6))
ui_set_graphics_10 = UiSetGraphics(Element=merge_25, PrimaryColor=cluster_11, AccentColor=gradient_7, StrokeColor=gradient_7)
constrloc = LBConstructLocation(name=replace_text_23, latitude=list_item_29, longitude=list_item_28, elevation=0)  # -> location; plug-in component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
format_16 = Format(Format="{0}_{1}.epw", Culture=127, Data0=list_item_30, Data1=list_item_31)
format_17 = Format(Format="Save {0}", Culture=127, Data0=format_16)
ui_button_8 = UiButton(Element=ui_button_6, Label=format_17)

merge_26 = Merge(Data1=merge_25)  # -> flatten(Result)
ui_window_2 = UiWindow(Elements=merge_26, Title="CSV weather data to EPW", Owner=1, Scroll=False, Launch=start_makeepw_green)
ui_set_graphics_11 = UiSetGraphics(
    Element=ui_window_2,
    PrimaryColor=RGB(128, 128, 128),
    AccentColor=RGB(128, 128, 128),
    StrokeColor=RGB(128, 128, 128),
    StrokeWeight=0)

# ---- group: make EPW 2.0.1 / selezionare l'anno e togliere il 29 feb
var = ValueList({"date": 1, "tempC": 4, "windspeedKmph": 7, "winddirdegree": 8, "precipMM": 13, "humidity": 15, "visibilityKm": 16, "pressureMB": 18, "cloudcover": 20, "DewPointC": 23}, selected="date")
tree_branch_7 = TreeBranch(Tree=cull_pattern_18, Path=var, MaintainPaths=True)
deconstruct_date_5 = DeconstructDate(Date=tree_branch_7)  # -> Year, Month, Day, Hour, Minute, Second
anno = Panel(list_item_31)
mese = Panel("2")
giorno = Panel("29")
equality_2 = Equality(FirstNumber=deconstruct_date_5.Year, SecondNumber=anno)  # -> Equality, Inequality
equality_3 = Equality(FirstNumber=deconstruct_date_5.Month, SecondNumber=mese)  # -> Equality, Inequality
equality_4 = Equality(FirstNumber=deconstruct_date_5.Day, SecondNumber=giorno)  # -> Equality, Inequality
gate_nand = GateNand(A=equality_3.Equality, B=equality_4.Equality)
gate_and = GateAnd(A=equality_2.Equality, B=gate_nand)

# ---- group: make EPW 2.0.1 / legg visibility
var_2 = ValueList({"date": 1, "tempC": 4, "windspeedKmph": 7, "winddirdegree": 8, "precipMM": 13, "humidity": 15, "visibilityKm": 16, "pressureMB": 18, "cloudcover": 20, "DewPointC": 23}, selected="visibilityKm")
tree_branch_8 = TreeBranch(Tree=cull_pattern_18, Path=var_2, MaintainPaths=True)
cull_pattern_20 = CullPattern(List=tree_branch_8, CullPattern=gate_and)
xdata_6 = LBDeconstructData(data=importepw_4.visibility)  # -> header, values; plug-in component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
data_3 = LBConstructData(header=xdata_6.header, values=cull_pattern_20)  # -> data; plug-in component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

# ---- group: make EPW 2.0.1 / leggi wind direction
var_3 = ValueList({"date": 1, "tempC": 4, "windspeedKmph": 7, "winddirdegree": 8, "precipMM": 13, "humidity": 15, "visibilityKm": 16, "pressureMB": 18, "cloudcover": 20, "DewPointC": 23}, selected="winddirdegree")
tree_branch_9 = TreeBranch(Tree=cull_pattern_18, Path=var_3, MaintainPaths=True)
cull_pattern_21 = CullPattern(List=tree_branch_9, CullPattern=gate_and)
xdata_7 = LBDeconstructData(data=importepw_4.wind_direction)  # -> header, values; plug-in component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
data_4 = LBConstructData(header=xdata_7.header, values=cull_pattern_21)  # -> data; plug-in component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

# ---- group: make EPW 2.0.1 / leggi wind speed
var_4 = ValueList({"date": 1, "tempC": 4, "windspeedKmph": 7, "winddirdegree": 8, "precipMM": 13, "humidity": 15, "visibilityKm": 16, "pressureMB": 18, "cloudcover": 20, "DewPointC": 23}, selected="windspeedKmph")
tree_branch_10 = TreeBranch(Tree=cull_pattern_18, Path=var_4, MaintainPaths=True)
cull_pattern_22 = CullPattern(List=tree_branch_10, CullPattern=gate_and)
division_2 = Division(A=cull_pattern_22, B=3.6)
xdata_8 = LBDeconstructData(data=importepw_4.wind_speed)  # -> header, values; plug-in component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
expression_5 = Expression(d=division_2, Expression="Round (d,2)")
data_5 = LBConstructData(header=xdata_8.header, values=expression_5)  # -> data; plug-in component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

# ---- group: make EPW 2.0.1 / legg pressure
var_5 = ValueList({"date": 1, "tempC": 4, "windspeedKmph": 7, "winddirdegree": 8, "precipMM": 13, "humidity": 15, "visibilityKm": 16, "pressureMB": 18, "cloudcover": 20, "DewPointC": 23}, selected="pressureMB")
tree_branch_11 = TreeBranch(Tree=cull_pattern_18, Path=var_5, MaintainPaths=True)
cull_pattern_23 = CullPattern(List=tree_branch_11, CullPattern=gate_and)
xdata_9 = LBDeconstructData(data=importepw_4.barometric_pressure)  # -> header, values; plug-in component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
multiplication = Multiplication(A=cull_pattern_23, B=100)
integer = Integer(multiplication)
data_6 = LBConstructData(header=xdata_9.header, values=integer)  # -> data; plug-in component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

# ---- group: make EPW 2.0.1 / legg _dew_point_temp
var_6 = ValueList({"date": 1, "tempC": 4, "windspeedKmph": 7, "winddirdegree": 8, "precipMM": 13, "humidity": 15, "visibilityKm": 16, "pressureMB": 18, "cloudcover": 20, "DewPointC": 23}, selected="DewPointC")
tree_branch_12 = TreeBranch(Tree=cull_pattern_18, Path=var_6, MaintainPaths=True)
cull_pattern_24 = CullPattern(List=tree_branch_12, CullPattern=gate_and)
xdata_10 = LBDeconstructData(data=importepw_4.dew_point_temperature)  # -> header, values; plug-in component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
data_7 = LBConstructData(header=xdata_10.header, values=cull_pattern_24)  # -> data; plug-in component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

# ---- group: make EPW 2.0.1 / legg total_sky_cover
var_7 = ValueList({"date": 1, "tempC": 4, "windspeedKmph": 7, "winddirdegree": 8, "precipMM": 13, "humidity": 15, "visibilityKm": 16, "pressureMB": 18, "cloudcover": 20, "DewPointC": 23}, selected="cloudcover")
tree_branch_13 = TreeBranch(Tree=cull_pattern_18, Path=var_7, MaintainPaths=True)
cull_pattern_25 = CullPattern(List=tree_branch_13, CullPattern=gate_and)
xdata_11 = LBDeconstructData(data=importepw_4.total_sky_cover)  # -> header, values; plug-in component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
division_3 = Division(A=cull_pattern_25, B=10)
integer_2 = Integer(division_3)
data_8 = LBConstructData(header=xdata_11.header, values=integer_2)  # -> data; plug-in component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

# ---- group: make EPW 2.0.1 / leggi temperatura
var_8 = ValueList({"date": 1, "tempC": 4, "windspeedKmph": 7, "winddirdegree": 8, "precipMM": 13, "humidity": 15, "visibilityKm": 16, "pressureMB": 18, "cloudcover": 20, "DewPointC": 23}, selected="tempC")
tree_branch_14 = TreeBranch(Tree=cull_pattern_18, Path=var_8, MaintainPaths=True)
cull_pattern_26 = CullPattern(List=tree_branch_14, CullPattern=gate_and)
xdata_12 = LBDeconstructData(data=importepw_4.dry_bulb_temperature)  # -> header, values; plug-in component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
data_9 = LBConstructData(header=xdata_12.header, values=cull_pattern_26)  # -> data; plug-in component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

# ---- group: make EPW 2.0.1 / crea nuovo epw
createepw = DFCreateEPW(
    location=constrloc,
    dry_bulb_temp=data_9,
    dew_point_temp=data_7,
    wind_speed=data_5,
    wind_direction=data_4,
    total_sky_cover=data_8,
    atmos_pressure=data_6,
    visibility=data_3,
    model_year=data_2,
    base_epw=downloadepw.epw_file,
    run=ui_values_21)  # -> out, epw_obj; plug-in component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
writeepw = DFWriteEPW(epw_obj=createepw.epw_obj, folder=relative_path, file_name=format_16, run=ui_values_21)  # -> out, epw_file; plug-in component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

# ---- group: UWG morphing 1.0.0 (continued)
trees = Geometry(cull_pattern_5)
terrain = Geometry(dynamic_geometry_pipeline_2)
ui_values_22 = UiValues(Element=ui_toggle)
ui_values_23 = UiValues(Element=ui_slider_8)
ui_values_24 = UiValues(Element=ui_slider_9)
ui_values_25 = UiValues(Element=ui_slider_7)
merge_27 = Merge(Data1=ui_label_7, Data2=ui_dropdown_list, Data3=ui_dropdown_list_2)
ui_values_26 = UiValues(Element=ui_dropdown_list)
ui_values_27 = UiValues(Element=ui_dropdown_list_2)
ui_align_8 = UiAlign(Element=merge_27, Alignment=3)
list_item_32 = ListItem(List=panel_14, Index=ui_values_26, Wrap=True)
list_item_33 = ListItem(List=panel_15, Index=ui_values_27, Wrap=True)
panel_25 = Panel(list_item_33)
panel_26 = Panel(list_item_32)
merge_28 = Merge(Data1=merge_14, Data2=ui_spacer_5)  # -> flatten(Result)
merge_29 = Merge(Data2=merge_12, Data3=ui_spacer_8)  # -> flatten(Result)
explode_tree_4 = ExplodeTree(Data=ui_values_25)  # -> Branch0, Branch1, Branch2, Branch3
stream_filter_6 = StreamFilter(Gate=ui_values_22, Stream0=ui_values_23)
uwgsimpar = DFUWGSimulationParameter(veg_par=vegetationpar, epw_site=refepwpar, bnd_layer=boundarylayer)  # -> sim_par; plug-in component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

series_9 = Series(Start=0, Step=1, Count=list_length_2)
duplicate_data_3 = DuplicateData(Data=series_3, Number=list_length_2, Order=True)
duplicate_data_4 = DuplicateData(Data=series_9, Number=3, Order=False)
ui_grid_layout_2 = UiGridLayout(Elements=flatten(merge_27), Columns=duplicate_data_3, Rows=duplicate_data_4)

ui_button_9 = UiButton(Label="Run UWG")
ui_align_9 = UiAlign(Element=ui_button_9, Alignment=3)

# ---- group: repday 5.3.3 (continued)
ui_text_block_3 = UiTextBlock(Element=ui_text_block, Text=format_15)  # -> flatten(Elements)

# ---- group: UWG morphing 1.0.0 (continued)
ui_values_28 = UiValues(Element=ui_button_9)
merge_30 = Merge(Data1=ui_button_9, Data2=ui_spacer_10)  # -> flatten(Result)
merge_31 = Merge(Data1=flatten(ui_grid_layout_2), Data2=ui_spacer_11)  # -> flatten(Result)
buildingsolid = DFBuildingFromSolid(bldg_geo=officesolids, floor_to_floor="@3", name=panel_26, program=panel_26, constr_set=panel_25, run=ui_values_28)  # -> report, buildings; plug-in component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
all_buildings = Data(flatten(buildingsolid.buildings))

# Create Dragonfly Model
toggle = BooleanToggle(True)
context = DFContextShade(geo=trees, name="Trees", uwg_is_veg=toggle)  # -> report, context; plug-in component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
model = DFModel(buildings=flatten(all_buildings), context=flatten(context.context), name=concatenate_2)  # -> report, model; plug-in component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

# Edit District UWG Properties
traffic = DFTrafficParameters(watts_per_area=ui_values_13)  # -> traffic; plug-in component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
terrain_2 = DFTerrain(
    terrain_geo=terrain,
    albedo=explode_tree_4.Branch0,
    thickness=explode_tree_4.Branch1,
    conductivity=explode_tree_4.Branch2,
    vol_heat_cap=explode_tree_4.Branch3)  # -> terrain; plug-in component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
modeluwg = DFAssignModelUWGProperties(model=model.model, terrain=terrain_2, traffic=traffic, tree_cover=stream_filter_6, grass_cover=ui_values_24)  # -> report, model; plug-in component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
panel_27 = Panel(modeluwg.report)

ui_expander_layout_10 = UiExpanderLayout(Elements=merge_28, Title="Set vegetation cover", Direction=0, Closed=True)

ui_expander_layout_11 = UiExpanderLayout(Elements=merge_8, Title="Weather data file", Direction=0, Closed=True)

ui_expander_layout_12 = UiExpanderLayout(Elements=merge_29, Title="Select terrain", Direction=0, Closed=True)

ui_expander_layout_13 = UiExpanderLayout(Elements=merge_7, Title="Set traffic properties", Direction=0, Closed=True)

ui_expander_layout_14 = UiExpanderLayout(Elements=merge_9, Title="Rural location information", Direction=0, Closed=True)

ui_expander_layout_15 = UiExpanderLayout(Elements=merge_30, Title="Urban Weather Generator", Direction=0, Closed=True)

ui_expander_layout_16 = UiExpanderLayout(Elements=merge_31, Title="Set building properties", Direction=0, Closed=True)

merge_32 = Merge(
    Data1=ui_expander_layout_16,
    Data2=ui_expander_layout_12,
    Data3=ui_expander_layout_13,
    Data4=ui_expander_layout_10,
    Data5=ui_expander_layout_14,
    Data6=ui_expander_layout_11,
    Data8=ui_expander_layout_15)
ui_window_3 = UiWindow(Elements=merge_32, Title="Morph an EPW with UWG", Owner=1, Scroll=False, Launch=start_update_uwgmorphing_orange)
ui_set_graphics_12 = UiSetGraphics(
    Element=ui_window_3,
    PrimaryColor=RGB(128, 128, 128),
    AccentColor=RGB(128, 128, 128),
    StrokeColor=RGB(128, 128, 128),
    StrokeWeight=0)

# ---- group: repday 5.3.3 / GUI: repday
ui_button_10 = UiButton(Label=cities)  # -> flatten(Elements)
ui_pick_date_3 = UiPickDate(DateTime=638051999444241591, Long=False)
ui_pick_date_4 = UiPickDate(DateTime=638051999444241591, Long=False)
ui_label_11 = UiLabel(Label="label")
ui_dropdown_list_3 = UiDropdownList(Values="ciao")
ui_dropdown_list_4 = UiDropdownList(Values="ciao")
ui_scroll_number = UiScrollNumber(Number=0, Wrap=False, Digits=1)
ui_label_12 = UiLabel(Label="Select the main variable and statement")
ui_values_29 = UiValues(Element=ui_dropdown_list_3)
panel_28 = Panel("""≥
≤""")
panel_29 = Panel("""is greater than or equal to
is less than or equal to""")
ui_label_13 = UiLabel(Label="Select period")
ui_pick_date_5 = UiPickDate(Element=ui_pick_date_3, DateTime=construct_exotic_date, Long=invert(False))
ui_values_30 = UiValues(Element=ui_scroll_number)
ui_pick_date_6 = UiPickDate(Element=ui_pick_date_4, DateTime=construct_exotic_date_2, Long=invert(False))
ui_values_31 = UiValues(Element=ui_dropdown_list_4)
ui_dropdown_list_5 = UiDropdownList(Element=ui_dropdown_list_4, Values=panel_28, Index=0)
select_units = SelectUnits(variables=read_data_10.Data, index=ui_values_29)  # -> units_2, var_2
ui_dropdown_list_6 = UiDropdownList(Element=ui_dropdown_list_3, Values=read_data_10.Data, Index=0)
list_item_34 = ListItem(List=panel_29, Index=ui_values_31, Wrap=True)
ui_scroll_number_2 = UiScrollNumber(Element=ui_scroll_number, Label=select_units.units_2, Number=25, Wrap=False, Digits=1)
ui_stack_layout_3 = UiStackLayout(Elements=[ui_label_13, ui_pick_date_4, ui_pick_date_3], Horizontal=True)
ui_stack_layout_4 = UiStackLayout(Elements=[ui_dropdown_list_3, ui_dropdown_list_4, ui_scroll_number], Horizontal=True)
ui_spacer_22 = UiSpacer(Width=10, Horizontal=False)
ui_spacer_23 = UiSpacer(Width=10, Horizontal=False)
ui_label_14 = UiLabel(Style=0)
format_18 = Format(
    Format="You are selecting days when the peak {0} {1} {2}{3}",
    Culture=127,
    Data0=select_units.var_2,
    Data1=list_item_34,
    Data2=ui_values_30,
    Data3=select_units.units_2)
ui_spacer_24 = UiSpacer(Element=[ui_spacer_22, ui_spacer_23], Width=20, Horizontal=invert(False))
ui_label_15 = UiLabel(Element=ui_label_14, Label=format_18, Style=0)
merge_33 = Merge(
    Data1=ui_stack_layout_3,
    Data2=ui_label_11,
    Data3=ui_spacer_22,
    Data4=ui_label_12,
    Data5=ui_stack_layout_4,
    Data6=ui_spacer_23,
    Data7=ui_label_14,
    Data8=ui_button_10)
ui_stack_layout_5 = UiStackLayout(Elements=merge_33, Horizontal=invert(True))
ui_expander_layout_17 = UiExpanderLayout(Elements=ui_stack_layout_5, Title="Calc the representative day for these locations:", Direction=0, Closed=invert(True))  # -> flatten(Element)

# ---- group: repday 5.3.3 / GUI: apparence
ui_align_10 = UiAlign(Element=graft([ui_button_2, ui_button_3, ui_button_10, ui_button_5, ui_button_4]), Alignment=3)

# ---- group: repday 5.3.3 / logic: exract period indexes
ui_values_32 = UiValues(Element=ui_pick_date_4)
ui_values_33 = UiValues(Element=ui_pick_date_3)
deconstruct_date_6 = DeconstructDate(Date=ui_values_32)  # -> Year, Month, Day, Hour, Minute, Second
deconstruct_date_7 = DeconstructDate(Date=ui_values_33)  # -> Year, Month, Day, Hour, Minute, Second
ghpython_script_2 = GhPythonScript(Year=deconstruct_date_6.Year, Month=deconstruct_date_6.Month, Day=deconstruct_date_6.Day)  # -> date
# ---------- ghpython_script_2: Python ----------
if Month<10:
    mm="0"+str(Month)
else:
    mm=str(Month)


if Day<10:
    dd="0"+str(Day)
else:
    dd=str(Day)
    
date=str(Year)+"-"+mm+"-"+dd+"-0"
# ---------- end ghpython_script_2 ----------
ghpython_script_3 = GhPythonScript(Year=deconstruct_date_7.Year, Month=deconstruct_date_7.Month, Day=deconstruct_date_7.Day)  # -> date; same code as ghpython_script_2
member_index_6 = MemberIndex(Set=read_data_11.Data, Member=[ghpython_script_2, ghpython_script_3])  # -> flatten(Index), Count
merge_34 = Merge(Data1=member_index_6.Index, Data2=-1)
list_item_35 = ListItem(List=merge_34, Index=[0, 1], Wrap=True)
sort_list_3 = SortList(Keys=list_item_35, ValuesValuesA=member_index_6.Count)  # -> Keys, ValuesValuesA
list_item_36 = ListItem(List=sort_list_3.Keys, Index=0, Wrap=invert(True))  # -> Item, Item1
addition_2 = Addition(A=list_item_36.Item, B=2)
addition_3 = Addition(A=list_item_36.Item1, B=25)

# ---- group: repday 5.3.3 / logic: exrract variable column
ui_values_34 = UiValues(Element=ui_dropdown_list_3)
cell_address = CellAddress(Column=expr("x+1+2", ui_values_34), Row=1, AbsoluteColumn=False, AbsoluteRow=False)
replace_text_24 = ReplaceText(Text=cell_address, Find="1", RecursiveReplace=False)

# ---- group: repday 5.3.3 / logic: start place selection
ui_values_35 = UiValues(Element=ui_button_10)  # -> flatten(Values)
member_index_7 = MemberIndex(Set=ui_values_35, Member=True)  # -> Index, Count
list_item_37 = ListItem(List=cities, Index=member_index_7.Index, Wrap=True)  # -> flatten(Item)
data_recorder_6 = DataRecorder(list_item_37, DataLimit=1, RecordData=True)
match_text_9 = MatchText(Text=sort_text_7.Values, RegEx="#", Case=True)
match_text_10 = MatchText(Text=sort_text_7.Values, RegEx=data_recorder_6, Case=True)
gate_and_2 = GateAnd(A=match_text_9, B=match_text_10)
cull_pattern_27 = CullPattern(List=sort_text_7.Values, CullPattern=gate_and_2)
list_item_38 = ListItem(List=cull_pattern_27, Index=0, Wrap=True)

# ---- group: repday 5.3.3 / logic: extract data in period
format_19 = Format(Format="{0}{1}:{0}{2}", Culture=127, Data0=replace_text_24, Data1=addition_2, Data2=addition_3)
read_data_13 = ReadData(Worksheet=list_item_38, Range=format_19, Activate=True)  # -> Range, flatten(Data)

format_20 = Format(Format="B{1}:B{2}", Culture=127, Data0=replace_text_24, Data1=addition_2, Data2=addition_3)
read_data_14 = ReadData(Worksheet=list_item_38, Range=format_20, Activate=True)  # -> Range, flatten(Data)

# ---- group: repday 5.3.3 / logic: calc repDay
mass_addition = MassAddition(Input=ui_values_35)  # -> Result, PartialResults
apply_statement = ApplyStatement(update=mass_addition.Result, statement=ui_values_31, value=ui_values_30, data=read_data_13.Data, dates=read_data_14.Data)  # -> datavalues_2, dates_4
representativeday_2_0 = GiornoRappresentativo10(data=apply_statement.datavalues_2, times=apply_statement.dates_4)  # -> outcome_2, sorted_times_2, sorted_data_2, representative_day_rd_2, least_representative_day_lrd_2, rd_values_2, lrd_values_2, typical_day_values_ck_2, deviation_3
message_2 = Panel(representativeday_2_0.outcome_2)

# ---- group: repday 5.3.3 / output: save resume and colours
text_fragment_2 = TextFragment(Text=data_recorder_6, Start=0, Count=23)
list_item_39 = ListItem(List=panel_28, Index=ui_values_31, Wrap=True)
panel_30 = Panel("""location
start date
end date
variable
statement
value
RD date
LRD date""")
format_21 = Format(Format="{0}-results", Culture=127, Data0=text_fragment_2)
merge_35 = Merge(
    Data1=flatten(data_recorder_6),
    Data2=flatten(ghpython_script_2),
    Data3=flatten(ghpython_script_3),
    Data4=flatten(select_units.var_2),
    Data5=flatten(list_item_39),
    Data6=flatten(ui_values_30),
    Data7=flatten(representativeday_2_0.representative_day_rd_2),
    Data8=flatten(representativeday_2_0.least_representative_day_lrd_2))
text_fragment_3 = TextFragment(Text=format_21, Start=0, Count=31)
list_length_23 = ListLength(List=panel_30)
list_length_24 = ListLength(List=merge_35)
match_text_11 = MatchText(Text=text_fragment_3, Pattern="-results", Case=True)
expression_6 = Expression(a=list_length_23, b=list_length_24, c=merge_35, Expression="If(a=b, 1, 0)")
stream_filter_7 = StreamFilter(Gate=match_text_11, Stream0=text_fragment_3)
activate_worksheet_3 = ActivateWorksheet(Worksheet=stream_filter_7)
stream_filter_8 = StreamFilter(Gate=match_text_11, Stream0=text_fragment_3)
longest_list_4 = LongestList(ListListA="0.0", ListListB=panel_30, PaddingMode=2)  # -> ListListA, ListListB
mass_addition_2 = MassAddition(Input=expression_6)  # -> Result, PartialResults
compile_row_2 = CompileRow(ColumnNames=panel_30, ColumnValues=merge_35, Format=longest_list_4.ListListB)
stream_filter_9 = StreamFilter(Gate=match_text_11, Stream0=mass_addition_2.Result)
write_data_2 = WriteData(Worksheet=activate_worksheet_3, Cell="a1", DataSet=compile_row_2, Clear=False, Activate=stream_filter_9)  # -> Worksheet, Range
save_workbook_2 = SaveWorkbook(
    Workbook=write_data_2.Worksheet,
    FolderPath=make_directory_paths.ghfilepath_3,
    FileName=make_directory_paths.db_workbook_4,
    Extensions=0,
    Activate=mass_addition_2.Result)  # -> Workbook, FilePath
range_color = RangeColor(Worksheet=write_data_2.Worksheet, Range="A1:H1", RangeColor=colour_swatch_2)
range_color_2 = RangeColor(Worksheet=write_data_2.Worksheet, Range="A3:F3", RangeColor=colour_swatch_3)

# ---- group: repday 5.3.3 / output: save rapDay list
weave = Weave(
    Pattern=[0, 1, 1, 1, 1, 1, 1, 1, 1, 1, 1, 1, 1, 1, 1, 1, 1, 1, 1, 1, 1, 1, 1, 1],
    Stream0=graft(representativeday_2_0.sorted_times_2),
    Stream1=[" ", " ", " ", " ", " ", " ", " ", " ", " ", " ", " ", " ", " ", " ", " ", " ", " ", " ", " ", " ", " ", " ", " "],
    NullGaps=False)
series_10 = Series(Start=0, Step=1, Count=24)
weave_2 = Weave(
    Pattern=[0, 1, 1, 1, 1, 1, 1, 1, 1, 1, 1, 1, 1, 1, 1, 1, 1, 1, 1, 1, 1, 1, 1, 1],
    Stream0=graft(representativeday_2_0.deviation_3),
    Stream1=[" ", " ", " ", " ", " ", " ", " ", " ", " ", " ", " ", " ", " ", " ", " ", " ", " ", " ", " ", " ", " ", " ", " "],
    NullGaps=False)
longest_list_5 = LongestList(ListListA=weave, ListListB=series_10, PaddingMode=2)  # -> ListListA, ListListB
longest_list_6 = LongestList(ListListA=weave, ListListB=representativeday_2_0.typical_day_values_ck_2, PaddingMode=2)  # -> ListListA, ListListB
longest_list_7 = LongestList(ListListA=weave, ListListB=data_recorder_6, PaddingMode=2)  # -> ListListA, ListListB
entwine_4 = Entwine(
    Branch00=longest_list_7.ListListB,
    Branch01=representativeday_2_0.sorted_data_2,
    Branch02=weave,
    Branch03=longest_list_5.ListListB,
    Branch04=weave_2,
    Branch05=longest_list_6.ListListB,
    FlattenInputs=True)
flip_matrix_4 = FlipMatrix(Data=entwine_4)
longest_list_8 = LongestList(ListListA=flip_matrix_4, ListListB="0.00", PaddingMode=2)  # -> ListListA, ListListB
panel_31 = Panel("""location
Sorted data
Sorted date
Hours
Deviation [%]
Typical day values (Ck)""")
compile_row_3 = CompileRow(ColumnNames=panel_31, ColumnValues=flip_matrix_4, Format=longest_list_8.ListListB)  # -> flatten(DataSet)
write_data_3 = WriteData(Worksheet=activate_worksheet_3, Cell="a3", DataSet=compile_row_3, Clear=True, Activate=mass_addition.Result)  # -> Worksheet, Range
save_workbook_3 = SaveWorkbook(
    Workbook=write_data_3.Worksheet,
    FolderPath=make_directory_paths.ghfilepath_3,
    FileName=make_directory_paths.db_workbook_4,
    Extensions=0,
    Activate=mass_addition.Result)  # -> Workbook, FilePath

# ---- group: repday 5.3.3 / GUI: window
start_repday_white = Button()
merge_36 = Merge(Data1=ui_expander_layout_5, Data2=ui_expander_layout_17, Data3=ui_stack_layout)
panel_32 = Panel("""Database |
Rep. Day |
Data viz""")
ui_tabbed_layout = UiTabbedLayout(Elements=flatten(merge_36), Names=panel_32)  # -> flatten(Element)
ui_window_4 = UiWindow(Elements=ui_tabbed_layout, Title="Representative Day", Owner=1, Scroll=True, Launch=start_repday_white)

# ---- group: UWG morphing 1.0.0 (continued)
list_length_25 = ListLength(List=merge_32)
series_11 = Series(Start=0, Step=1, Count=list_length_25)
runuwg = DFRunUrbanWeatherGenerator(model=modeluwg.model, epw_file=ui_values_11, sim_par=uwgsimpar, folder=text_join, write=ui_values_28, run=ui_values_28)  # -> report, uwg_json, urban_epw; plug-in component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

list_length_26 = ListLength(List=series_11)  # -> expr("x-1", Length)
remap_numbers_3 = RemapNumbers(Value=series_11, Source=list_length_26, Target=Domain(0, 1))  # -> Mapped, Clipped
gradient_8 = Gradient(LowerLimit=0, UpperLimit=1, Parameter=reverse(remap_numbers_3.Mapped), stops=[0: RGB(181, 0, 124), 1: RGB(255, 187, 0)])
list_item_40 = ListItem(List=gradient_8, Index=1, Wrap=True)  # -> Item, Item1, Item2, Item3, Item4, Item5, Item6

cluster_12 = Cluster(colour=list_item_40.Item4)
cluster_13 = Cluster_2(colour=list_item_40.Item4)
ui_set_graphics_13 = UiSetGraphics(Element=ui_load_button, PrimaryColor=cluster_13, AccentColor=cluster_12)
cluster_14 = Cluster(colour=list_item_40.Item6)
cluster_15 = Cluster_2(colour=list_item_40.Item6)
ui_set_graphics_14 = UiSetGraphics(Element=merge_27, PrimaryColor=cluster_15, AccentColor=cluster_14, StrokeColor=RGBA(255, 54, 54, 0))

cluster_16 = Cluster(colour=list_item_40.Item5)
cluster_17 = Cluster_2(colour=list_item_40.Item5)
ui_set_graphics_15 = UiSetGraphics(Element=ui_button_9, PrimaryColor=cluster_17, AccentColor=cluster_16)

cluster_18 = Cluster_2(colour=list_item_40.Item2)
ui_set_graphics_16 = UiSetGraphics(Element=ui_expander_layout_10, PrimaryColor=cluster_18, AccentColor=list_item_40.Item2, StrokeColor=list_item_40.Item2)

cluster_19 = Cluster_2(colour=list_item_40.Item4)
ui_set_graphics_17 = UiSetGraphics(Element=ui_expander_layout_11, PrimaryColor=cluster_19, AccentColor=list_item_40.Item4, StrokeColor=list_item_40.Item4)

cluster_20 = Cluster_2(colour=list_item_40.Item1)
ui_set_graphics_18 = UiSetGraphics(Element=ui_expander_layout_13, PrimaryColor=cluster_20, AccentColor=list_item_40.Item1, StrokeColor=list_item_40.Item1)

cluster_21 = Cluster_2(colour=list_item_40.Item)
ui_set_graphics_19 = UiSetGraphics(Element=ui_expander_layout_12, PrimaryColor=cluster_21, AccentColor=list_item_40.Item, StrokeColor=list_item_40.Item)

cluster_22 = Cluster_2(colour=list_item_40.Item3)
ui_set_graphics_20 = UiSetGraphics(Element=ui_expander_layout_14, PrimaryColor=cluster_22, AccentColor=list_item_40.Item3, StrokeColor=list_item_40.Item3)

cluster_23 = Cluster_2(colour=list_item_40.Item5)
ui_set_graphics_21 = UiSetGraphics(Element=ui_expander_layout_15, PrimaryColor=cluster_23, AccentColor=list_item_40.Item5, StrokeColor=list_item_40.Item5)

cluster_24 = Cluster_2(colour=list_item_40.Item6)
ui_set_graphics_22 = UiSetGraphics(Element=ui_expander_layout_16, PrimaryColor=cluster_24, AccentColor=list_item_40.Item6, StrokeColor=list_item_40.Item6)

# ---- group: repday 5.3.3 / GUI: period label
list_item_41 = ListItem(List=sort_list_3.ValuesValuesA, Index=0, Wrap=invert(True))  # -> Item, Item1
gate_not_2 = GateNot(A=list_item_41.Item)
gate_not_3 = GateNot(A=list_item_41.Item1)
gate_and_3 = GateAnd(A=gate_not_2, B=gate_not_3)
stream_filter_10 = StreamFilter(Gate=list_item_41.Item, Stream0="The starting date is earlier than those in the database")
stream_filter_11 = StreamFilter(Gate=list_item_41.Item1, Stream0="The ending date is after those in the database")

# ---- group: repday 5.3.3 (continued)
concatenate_8 = Concatenate(FragmentA=stream_filter_10, FragmentB=" ")
concatenate_9 = Concatenate(FragmentA=stream_filter_11, FragmentB=" ")

# ---- group: repday 5.3.3 / GUI: period label (continued)
merge_37 = Merge(Data1=concatenate_8, Data2=concatenate_9)
stream_filter_12 = StreamFilter(Gate=gate_and_3, Stream0=merge_37, Stream1="The required dates are beyond those in the database")

# ---- group: repday 5.3.3 / GUI: repday (continued)
ui_label_16 = UiLabel(Element=ui_label_11, Label=stream_filter_12)

# ==== cluster Cluster
colour = ClusterInput()
split_ahsl = SplitAHSL(Colour=colour)  # -> Alpha, Hue, Saturation, Luminance
colour_hsl = ColourHSL(
    Alpha=split_ahsl.Alpha,
    Hue=split_ahsl.Hue,
    Saturation=split_ahsl.Saturation,
    Luminance=expr("x/1.3", split_ahsl.Luminance))
colour_2 = ClusterOutput(colour_hsl)

# ==== cluster Cluster_2
colour = ClusterInput()
split_argb = SplitARGB(Colour=colour, IntegerChannels=True)  # -> Alpha, Red, Green, Blue
subtraction = Subtraction(A=255, B=split_argb.Red)
subtraction_2 = Subtraction(A=255, B=split_argb.Green)
subtraction_3 = Subtraction(A=255, B=split_argb.Blue)
colour_rgb = ColourRGB(Alpha=255, Red=subtraction, Green=subtraction_2, Blue=subtraction_3)
split_ahsl = SplitAHSL(Colour=colour_rgb)  # -> Alpha, Hue, Saturation, Luminance
integer = Integer(split_ahsl.Luminance)
colour_rgb_f = ColourRGBF(Alpha=1, Red=integer, Green=integer, Blue=integer)
colour_2 = ClusterOutput(colour_rgb_f)

# ==== cluster GetCitiesFromCoordinates
location_path = ClusterInput()
run = ClusterInput()
location_path_2 = Text(location_path)
run_2 = Boolean(run)
stream_filter = StreamFilter(Gate=run_2, Stream1=location_path_2)
read_file = ReadFile(File=stream_filter, PerLineParse=True)
cull_index = CullIndex(List=read_file, Indices=0, Wrap=True)
text_split = TextSplit(Text=cull_index, Separators=",")  # -> simplify(Result)
csv = ValueList({"id": "0", "lat": "1", "lon": "2", "place": "3"}, selected="place")
csv_2 = ValueList({"id": "0", "lat": "1", "lon": "2", "place": "3"}, selected="id")
csv_3 = ValueList({"id": "0", "lat": "1", "lon": "2", "place": "3"}, selected="lat")
csv_4 = ValueList({"id": "0", "lat": "1", "lon": "2", "place": "3"}, selected="lon")
flip_matrix = FlipMatrix(Data=text_split)  # -> simplify(Data)
tree_branch = TreeBranch(Tree=flip_matrix, Path=csv, MaintainPaths=True)
tree_branch_2 = TreeBranch(Tree=flip_matrix, Path=csv_2, MaintainPaths=True)
tree_branch_3 = TreeBranch(Tree=flip_matrix, Path=csv_3, MaintainPaths=True)
tree_branch_4 = TreeBranch(Tree=flip_matrix, Path=csv_4, MaintainPaths=True)
replace_text = ReplaceText(Text=tree_branch, Find="\"", RecursiveReplace=False)
cities = Text(replace_text)
sort_text = SortText(Keys=cities, Culture=127)  # -> Keys, Values
loc_id = Integer(tree_branch_2)
loc_id_2 = ClusterOutput(loc_id)
cities_2 = Text(sort_text.Keys)
cities_3 = ClusterOutput(cities_2)

# ==== cluster MakeDirectoryPaths
location_worksheet_name = ClusterInput()
weather_worksheet_name = ClusterInput()
ghfilepath = ClusterInput()
db_workbook = ClusterInput()
location_worksheet_name_2 = Text(location_worksheet_name)
weather_worksheet_name_2 = Text(weather_worksheet_name)
ghfilepath_2 = Data(ghfilepath)
db_workbook_2 = Text(db_workbook)
concatenate = Concatenate(Fragment_A=ghfilepath_2, Fragment_B=location_worksheet_name_2, A=".csv")
concatenate_2 = Concatenate(Fragment_A=ghfilepath_2, Fragment_B=weather_worksheet_name_2, A=".csv")
weather_data_1hr_path = Data(concatenate_2)
db_workbook_3 = Text(db_workbook_2)
location_path = Data(concatenate)
ghfilepath_3 = ClusterOutput(ghfilepath_2)
location_path_2 = ClusterOutput(location_path)
weather_data_1hr_path_2 = ClusterOutput(weather_data_1hr_path)
location_worksheet_name_3 = ClusterOutput(location_worksheet_name_2)
weather_worksheet_name_3 = ClusterOutput(weather_worksheet_name_2)
db_workbook_4 = ClusterOutput(db_workbook_3)

# ==== cluster CheckDirectoryConsistence
weather_data_1hr_path = ClusterInput()
location_path = ClusterInput()
weather_data_1hr_path_2 = Data(weather_data_1hr_path)
location_path_2 = Data(location_path)
file_or_directory_exists = FileOrDirectoryExists(Path=location_path_2)
file_or_directory_exists_2 = FileOrDirectoryExists(Path=weather_data_1hr_path_2)
error = Panel("Please, place the purchased files in the same directory as the repDay file")
ok = Panel("All done! :)")
gate_and = GateAnd(A=file_or_directory_exists, B=file_or_directory_exists_2)
stream_filter = StreamFilter(Gate=gate_and, Stream0=error, Stream1=ok)
stream_filter_2 = StreamFilter(Gate=gate_and, Stream0=0, Stream1=1)
check = Boolean(stream_filter_2)
message = Text(stream_filter)
message_2 = ClusterOutput(message)
check_2 = ClusterOutput(check)

# ==== cluster CanRun
check = ClusterInput()
run = ClusterInput()
check_2 = Boolean(check)
run_2 = Boolean(run)
gate_and = GateAnd(A=check_2, B=run_2)
run_3 = Boolean(gate_and)
run_4 = ClusterOutput(run_3)

# ==== cluster SelectetVariableAndRemove2902
weather_data_1hr_path = ClusterInput()
format = ClusterInput()
run = ClusterInput()
cities = ClusterInput()
city_index = ClusterInput()
weather_data_1hr_path_2 = Text(weather_data_1hr_path)
run_2 = Boolean(run)
stream_filter = StreamFilter(Gate=run_2, Stream1=weather_data_1hr_path_2)
cities_2 = Text(cities)
city_index_2 = Integer(city_index)
format_2 = Text(format)
read_file = ReadFile(File=stream_filter, PerLineParse=True)
text_fragment = TextFragment(Text=read_file, Start=0, Count=3)
text_split = TextSplit(Text=text_fragment, Separators=",")
list_item = ListItem(List=text_split, Index=0, Wrap=True)  # -> flatten(Item)
cull_index = CullIndex(List=list_item, Indices=0, Wrap=True)
create_set = CreateSet(List=cull_index)  # -> Set, Map
cull_index_2 = CullIndex(List=read_file, Indices=0, Wrap=True)
list_item_2 = ListItem(List=read_file, Index=0, Wrap=True)
assignpaths = AssignPaths(InputData=flatten(cull_index_2), PathsToAssign=flatten(create_set.Map))
tree_branch = TreeBranch(Tree=assignpaths, Path=city_index_2, MaintainPaths=True)
weather_data_1hr_header = ValueList({"loc_id": "0", "date": "1", "time": "2", "isdaytime": "3", "tempC": "4", "tempF": "5", "windspeedMiles": "6", "windspeedKmph": "7", "winddirdegree": "8", "winddir16point": "9"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}, selected="date")
text_split_2 = TextSplit(Text=list_item_2, Separators=",")  # -> simplify(graft(Result))
text_split_3 = TextSplit(Text=tree_branch, Separators=",")  # -> simplify(Result)
flip_matrix = FlipMatrix(Data=text_split_3)
tree_branch_2 = TreeBranch(Tree=flip_matrix, Path=weather_data_1hr_header, MaintainPaths=True)
time = Time(tree_branch_2)
weather_data_1hr_header_2 = ValueList({"loc_id": "0", "date": "1", "time": "2", "isdaytime": "3", "tempC": "4", "tempF": "5", "windspeedMiles": "6", "windspeedKmph": "7", "winddirdegree": "8", "winddir16point": "9"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}, selected=["loc_id", "date", "tempC", "windspeedKmph", "winddirdegree", "precipMM": "13", "humidity": "15", "visibilityKm": "16", "pressureMB": "18", "cloudcover": "20", "DewPointC": "23"])
weather_data_1hr_header_3 = ValueList({"loc_id": "0", "date": "1", "time": "2", "isdaytime": "3", "tempC": "4", "tempF": "5", "windspeedMiles": "6", "windspeedKmph": "7", "winddirdegree": "8", "winddir16point": "9"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}, selected=["winddirdegree", "precipMM": "13", "visibilityKm": "16", "pressureMB": "18", "cloudcover": "20", "DewPointC": "23"])
weather_data_1hr_header_4 = ValueList({"loc_id": "0", "date": "1", "time": "2", "isdaytime": "3", "tempC": "4", "tempF": "5", "windspeedMiles": "6", "windspeedKmph": "7", "winddirdegree": "8", "winddir16point": "9"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}, selected="windspeedKmph")
weather_data_1hr_header_5 = ValueList({"loc_id": "0", "date": "1", "time": "2", "isdaytime": "3", "tempC": "4", "tempF": "5", "windspeedMiles": "6", "windspeedKmph": "7", "winddirdegree": "8", "winddir16point": "9"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}, selected="humidity": "15")
weather_data_1hr_header_6 = ValueList({"loc_id": "0", "date": "1", "time": "2", "isdaytime": "3", "tempC": "4", "tempF": "5", "windspeedMiles": "6", "windspeedKmph": "7", "winddirdegree": "8", "winddir16point": "9"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}, selected="loc_id")
weather_data_1hr_header_7 = ValueList({"loc_id": "0", "date": "1", "time": "2", "isdaytime": "3", "tempC": "4", "tempF": "5", "windspeedMiles": "6", "windspeedKmph": "7", "winddirdegree": "8", "winddir16point": "9"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}, selected="time")
weather_data_1hr_header_8 = ValueList({"loc_id": "0", "date": "1", "time": "2", "isdaytime": "3", "tempC": "4", "tempF": "5", "windspeedMiles": "6", "windspeedKmph": "7", "winddirdegree": "8", "winddir16point": "9"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}, selected="tempC")
deconstruct_date = DeconstructDate(Date=time)  # -> Year, Month, Day, Hour, Minute, Second
equality = Equality(FirstNumber=deconstruct_date.Month, SecondNumber=2)  # -> Equality, Inequality
equality_2 = Equality(FirstNumber=deconstruct_date.Day, SecondNumber=29)  # -> Equality, Inequality
gate_nand = GateNand(A=equality.Equality, B=equality_2.Equality)
tree_branch_3 = TreeBranch(Tree=flip_matrix, Path=weather_data_1hr_header_4, MaintainPaths=True)
tree_branch_4 = TreeBranch(Tree=flip_matrix, Path=weather_data_1hr_header_5, MaintainPaths=True)
tree_branch_5 = TreeBranch(Tree=flip_matrix, Path=weather_data_1hr_header_7, MaintainPaths=True)
tree_branch_6 = TreeBranch(Tree=flip_matrix, Path=weather_data_1hr_header_8, MaintainPaths=True)
tree_branch_7 = TreeBranch(Tree=flip_matrix, Path=weather_data_1hr_header_6, MaintainPaths=True)
tree_branch_8 = TreeBranch(Tree=flip_matrix, Path=weather_data_1hr_header_3, MaintainPaths=True)
tree_branch_9 = TreeBranch(Tree=text_split_2, Path=weather_data_1hr_header_2, MaintainPaths=True)  # -> flatten(Branch)
division = Division(A=tree_branch_5, B=100)
division_2 = Division(A=tree_branch_3, B="3.6")
list_item_3 = ListItem(List=cities_2, Index=expr("x-1", tree_branch_7), Wrap=True)  # -> flatten(Item)
merge = Merge(Data1=tree_branch_9, Data2="UTCI (°C)")  # -> flatten(Result)
utci = LBUTCIComfort(air_temp=tree_branch_6, rel_humid=tree_branch_4, wind_vel=division_2, run=True)  # -> out, utci, comfort, condition, category, comf_obj; plug-in component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
replace_text = ReplaceText(Text=merge, Find="tempC", Replace="temperature (°C)", RecursiveReplace=False)
replace_text_2 = ReplaceText(Text=replace_text, Find="windspeedKmph", Replace="wind speed (m/s)", RecursiveReplace=False)
concatenate = Concatenate(FragmentA=tree_branch_2, FragmentB=division, JoinSeparator="-")
replace_text_3 = ReplaceText(Text=replace_text_2, Find="winddirdegree", Replace="wind direction (°)", RecursiveReplace=False)
unflatten_tree = UnflattenTree(Tree=concatenate, Guide=tree_branch_2)
replace_text_4 = ReplaceText(Text=replace_text_3, Find="precipMM", Replace="precip (mm)", RecursiveReplace=False)
path_mapper = PathMapper(utci.utci, source="{A}", target="{100}")
windspeed_m_s = Number(expr("Round(x,2)", division_2))
otherdata = Text(tree_branch_8)
utci_2 = Number(expr("Round(x,2)", path_mapper))
newdate = Text(unflatten_tree)
humidity = Text(tree_branch_4)
loc_id = Text(list_item_3)
tempc = Text(tree_branch_6)
replace_text_5 = ReplaceText(Text=replace_text_4, Find="humidity", Replace="humidity (%)", RecursiveReplace=False)
merge_2 = Merge(Data1=loc_id, Data2=newdate, Data3=otherdata, Data4=tempc, Data5=windspeed_m_s, Data6=humidity, Data7=utci_2)
replace_text_6 = ReplaceText(Text=replace_text_5, Find="visibilityKm", Replace="visibility (Km)", RecursiveReplace=False)
path_mapper_2 = PathMapper(merge_2, source="{A}", target="{path_index}")
replace_text_7 = ReplaceText(Text=replace_text_6, Find="DewPointC", Replace="Dew Point (°C)", RecursiveReplace=False)
panel = Panel(replace_text)
replace_text_8 = ReplaceText(Text=replace_text_7, Find="pressureMB", Replace="pressure (mB)", RecursiveReplace=False)
cull_pattern = CullPattern(List=path_mapper_2, CullPattern=gate_nand)
tree_branch_10 = TreeBranch(Tree=cull_pattern, Path="{0}", MaintainPaths=True)
flip_matrix_2 = FlipMatrix(Data=cull_pattern)
list_item_4 = ListItem(List=cities_2, Index=city_index_2, Wrap=True)
list_length = ListLength(List=tree_branch_10)  # -> expr("x+1", Length)
selected_data = Text(flip_matrix_2)
longest_list = LongestList(ListListA=selected_data, ListListB=format_2, PaddingMode=2)  # -> ListListA, ListListB
selected_labels = Text(replace_text_8)
format_3 = Format(Format="{0}#{1}", Culture=127, Data0=list_item_4, Data1=list_length)
panel_2 = Panel(selected_labels)
selected_labels_2 = ClusterOutput(selected_labels)
selected_data_2 = ClusterOutput(selected_data)
format_4 = Text(longest_list.ListListB)
format_5 = ClusterOutput(format_4)
member_index = MemberIndex(Set=format_3, Member="#")  # -> Index, Count
cull_index_3 = CullIndex(List=format_3, Indices=member_index.Index, Wrap=True)
worksheet = Text(flatten(cull_index_3))
worksheet_2 = ClusterOutput(worksheet)

# ==== cluster SelectUnits
index = ClusterInput()
variables = ClusterInput()
variables_2 = Text(variables)
list_item = ListItem(List=variables_2, Index=index, Wrap=True)
text_split = TextSplit(Text=list_item, Separators="(")
list_length = ListLength(List=text_split)  # -> expr("x-1", Length)
replace_text = ReplaceText(Text=text_split, Find=")", RecursiveReplace=False)
list_item_2 = ListItem(List=replace_text, Index=1, Wrap=True)  # -> Item1, Item
stream_filter = StreamFilter(Gate=list_length, Stream0=" ", Stream1=list_item_2.Item)
var = Text(list_item_2.Item1)
units = Text(stream_filter)
var_2 = ClusterOutput(var)
units_2 = ClusterOutput(units)

# ==== cluster GiornoRappresentativo10: versione 1.0 del porting dell'algoritmo per la ricerca del giorno rappresentativo
data = ClusterInput()  # Enter 24 values for each day you want to calculate
times = ClusterInput()  # Enter the given string for each day you want to calculate

# ---- group: check errors
data_2 = Number(flatten(data))
times_2 = Data(flatten(times))
list_length = ListLength(List=data_2)
list_length_2 = ListLength(List=times_2)
division = Division(A=list_length, B=24)
equality = Equality(FirstNumber=division, SecondNumber=list_length_2)  # -> Equality, Inequality
stream_filter = StreamFilter(Gate=equality.Equality, Stream1=data_2)
stream_filter_2 = StreamFilter(Gate=equality.Equality, Stream1=times_2)
panel = Panel(":( please enter a consistent number of data: 24 data for each time you enter")
stream_filter_3 = StreamFilter(Gate=equality.Equality, Stream0=panel, Stream1=":) all done!")
outcome = Text(stream_filter_3)
outcome_2 = ClusterOutput(outcome)

# ---- group: import dati e corretto incolonnamento
data_3 = Number(stream_filter)
list_length_3 = ListLength(List=data_3)
number_slider = Slider(24, range=0..100)
partition_list = PartitionList(List=data_3, Size=number_slider)
flip_matrix = FlipMatrix(Data=partition_list)
division_2 = Division(A=list_length_3, B=number_slider)
flipped_data = Data(flip_matrix)
N = Data(division_2)
data_4 = Data(data_3)

# ---- group: Matrice degli scarti
flipped_data_2 = Data(flipped_data)
N_2 = Data(N)
duplicate_data = DuplicateData(Data=flipped_data_2, Number=N_2, Order=True)
duplicate_data_2 = DuplicateData(Data=flipped_data_2, Number=N_2, Order=invert(True))
subtraction = Subtraction(A=duplicate_data, B=duplicate_data_2)  # -> flatten(Result)
multiplication = Multiplication(A=N_2, B=N_2)  # -> flatten(Result)
multiplication_2 = Multiplication(A=subtraction, B=subtraction)
partition_list_2 = PartitionList(List=multiplication_2, Size=multiplication)  # -> simplify(Chunks)
flip_matrix_2 = FlipMatrix(Data=partition_list_2)
mass_addition = MassAddition(Input=flip_matrix_2)  # -> flatten(Result), PartialResults
scarti = Data(mass_addition.Result)

# ---- group: ordinamento dei dati
N_3 = Data(N)
times_3 = Data(stream_filter_2)
scarti_2 = Data(scarti)
partition_list_3 = PartitionList(List=scarti_2, Size=N_3)  # -> simplify(Chunks)
mass_addition_2 = MassAddition(Input=partition_list_3)  # -> flatten(Result), PartialResults
series = Series(Start=0, Step=1, Count=N_3)
sort_list = SortList(Keys=mass_addition_2.Result, ValuesValuesA=times_3, ValuesA=series)  # -> Keys, ValuesValuesA, ValuesA
date_ordinate = Data(sort_list.ValuesValuesA)
sorted_index = Data(sort_list.ValuesA)
deviation = Data(sort_list.Keys)

# ---- group: output dati
sorted_times = Data(date_ordinate)
dato_rilevato = Data(data_4)
sorted_index_2 = Data(sorted_index)
bounds = Bounds(Numbers=deviation)
list_item = ListItem(List=sorted_times, Index=0, Wrap=True)
list_item_2 = ListItem(List=reverse(sorted_index_2), Index=0, Wrap=True)
partition_list_4 = PartitionList(List=dato_rilevato, Size=24)  # -> simplify(Chunks)
list_item_3 = ListItem(List=sorted_index_2, Index=0, Wrap=True)
remap_numbers = RemapNumbers(Value=deviation, Source=bounds, Target=Domain(0, 100))  # -> Mapped, Clipped
tree_branch = TreeBranch(Tree=partition_list_4, Path=list_item_2, MaintainPaths=True)
tree_branch_2 = TreeBranch(Tree=partition_list_4, Path=sorted_index_2, MaintainPaths=False)
tree_branch_3 = TreeBranch(Tree=partition_list_4, Path=list_item_3, MaintainPaths=True)
list_item_4 = ListItem(List=reverse(sorted_times), Index=0, Wrap=True)
expression = Expression(a=remap_numbers.Mapped, Expression="Round (a,1)")
round = Round(Number=expression)  # -> Nearest, Floor, Ceiling
equality_2 = Equality(FirstNumber=round.Nearest, SecondNumber=expression)  # -> Equality, Inequality
dispatch = Dispatch(List=expression, DispatchPattern=equality_2.Equality)  # -> ListA, ListB
concatenate = Concatenate(FragmentA=dispatch.ListA, FragmentB=".0")
weave = Weave(Pattern=equality_2.Inequality, Stream0=concatenate, Stream1=dispatch.ListB, NullGaps=False)
least_representative_day_lrd = Data(list_item_4)
representative_day_rd = Data(list_item)
deviation_2 = Data(weave)
sorted_data = Data(tree_branch_2)
lrd_values = Data(tree_branch)
rd_values = Data(tree_branch_3)

# ----
tree_branch_4 = TreeBranch(Tree=partition_list_4, Path=sorted_index_2, MaintainPaths=False)
flip_matrix_3 = FlipMatrix(Data=tree_branch_4)
average = Average(Input=flip_matrix_3)  # -> flatten(ArithmeticMean)
typical_day_values_ck = Number(average)
least_representative_day_lrd_2 = ClusterOutput(least_representative_day_lrd)
representative_day_rd_2 = ClusterOutput(representative_day_rd)
typical_day_values_ck_2 = ClusterOutput(typical_day_values_ck)
deviation_3 = ClusterOutput(deviation_2)
sorted_times_2 = ClusterOutput(sorted_times)
sorted_data_2 = ClusterOutput(sorted_data)
lrd_values_2 = ClusterOutput(lrd_values)
rd_values_2 = ClusterOutput(rd_values)

# ==== cluster ApplyStatement
update = ClusterInput()
data = ClusterInput()
statement = ClusterInput()
value = ClusterInput()
dates = ClusterInput()
data_2 = Data(data)
update_2 = Boolean(update)
value_2 = Number(value)
statement_2 = Integer(statement)
dates_2 = Data(dates)
stream_filter = StreamFilter(Gate=update_2, Stream1=statement_2)
stream_filter_2 = StreamFilter(Gate=update_2, Stream1=value_2)
stream_filter_3 = StreamFilter(Gate=update_2, Stream1=data_2)
stream_filter_4 = StreamFilter(Gate=update_2, Stream1=dates_2)
partition_list = PartitionList(List=stream_filter_3, Size=24)
sort_text = SortText(Keys=partition_list, Culture=127)  # -> Keys, Values
list_item = ListItem(List=sort_text.Keys, Index=0, Wrap=True)  # -> Item1, Item
larger_than = LargerThan(FirstNumber=list_item.Item1, SecondNumber=stream_filter_2)  # -> LargerThan, OrEqualTo
smaller_than = SmallerThan(FirstNumber=list_item.Item, SecondNumber=stream_filter_2)  # -> SmallerThan, OrEqualTo
stream_filter_5 = StreamFilter(Gate=stream_filter, Stream0=larger_than.OrEqualTo, Stream1=smaller_than.OrEqualTo)
partition_list_2 = PartitionList(List=stream_filter_4, Size=24)
stream_gate = StreamGate(Stream=stream_filter_5, Gate=stream_filter)  # -> Target0, Target1
list_item_2 = ListItem(List=partition_list_2, Index=0, Wrap=True)
cull_pattern = CullPattern(List=partition_list, CullPattern=stream_gate.Target0)
cull_pattern_2 = CullPattern(List=partition_list, CullPattern=stream_gate.Target1)
cull_pattern_3 = CullPattern(List=list_item_2, CullPattern=stream_filter_5)
clean_tree = CleanTree(RemoveNulls=True, RemoveInvalid=True, RemoveEmpty=invert(False), Tree=cull_pattern)
clean_tree_2 = CleanTree(RemoveNulls=True, RemoveInvalid=True, RemoveEmpty=invert(False), Tree=cull_pattern_2)
clean_tree_3 = CleanTree(RemoveNulls=True, RemoveInvalid=True, RemoveEmpty=invert(False), Tree=cull_pattern_3)
deconstruct_date = DeconstructDate(Date=clean_tree_3)  # -> Year, Month, Day, Hour, Minute, Second
construct_exotic_date = ConstructExoticDate(Year=deconstruct_date.Year, Month=deconstruct_date.Month, Day=deconstruct_date.Day, Calendar=0)
merge = Merge(Data1=clean_tree, Data2=clean_tree_2)  # -> flatten(Result)
dates_3 = Time(flatten(construct_exotic_date))
datavalues = Number(flatten(merge))
dates_4 = ClusterOutput(dates_3)
datavalues_2 = ClusterOutput(datavalues)
