# Grasshopper definition unicamTools2.0.gh (Grasshopper 1.0.7)
# plug-ins: Hops, MetaHopper

location_worksheet_name = Panel("locations")
weather_worksheet_name = Panel("weather_data_1hr")
new_workbook = Panel("DBresults")
relative_path = RelativePath(Path=".\")
run = BooleanToggle(True)
document_info = DocumentInfo(AutoUpdate=invert(False), Recursive=invert(False))  # -> DocumentName, DocumentFilePath, Components, Params, _3rdPartyAssemblies; disabled
format = Format(Format="{0}{1}\{2}.gh", Culture=127, Data0=relative_path, Data1="white", Data2="make directory paths")
hops = Hops(
    _Path=format,
    _Enabled=run,
    GhFilePath=relative_path,
    LocationWorksheetName=location_worksheet_name,
    WeatherWorksheetName=weather_worksheet_name,
    DBWorkbook=new_workbook,
    CacheResultsInMemory=False,
    CacheSolveResults=False,
    RemoteDefinitionLocation="C:\Users\ionon\OneDrive - Università di Camerino\Documents\GitHub\unicamTools\white\make directory paths.gh",
    RemoteSolveVersion=(0, 1, 0),
    ShowInput_Enabled=True,
    ShowInput_Path=True,
    SynchronousSolve=False)  # -> LocationPath, Weather_data_1hrPath, DBWorkbook
format_2 = Format(Format="{0}{1}\{2}.gh", Culture=127, Data0=relative_path, Data1="white", Data2="check directory consistence py")
hops_2 = Hops(
    _Path=format_2,
    _Enabled=run,
    LocationPath=hops.LocationPath,
    Weather_data_1hrPath=hops.Weather_data_1hrPath,
    CacheResultsInMemory=False,
    CacheSolveResults=False,
    RemoteDefinitionLocation="C:\Users\ionon\OneDrive - Università di Camerino\Documents\GitHub\unicamTools\white\check directory consistence py.gh",
    RemoteSolveVersion=(0, 1, 0),
    ShowInput_Enabled=True,
    ShowInput_Path=True,
    SynchronousSolve=True)  # -> Message, Check
panel = Panel(hops_2.Check)
panel_2 = Panel("white")  # disabled
panel_3 = Panel("Get cities from coordinates")  # disabled
format_3 = Format(Format="{0}{1}\{2}.gh", Culture=127, Data0=relative_path, Data1=panel_2, Data2=panel_3)  # disabled
hops_3 = Hops(
    _Path=format_3,
    Run=hops_2.Check,
    LocationPath=hops.LocationPath,
    CacheResultsInMemory=False,
    CacheSolveResults=False,
    RemoteDefinitionLocation="C:\Users\ionon\OneDrive - Università di Camerino\Documents\GitHub\unicamTools\white\Get cities from coordinates.gh",
    RemoteSolveVersion=(0, 1, 0),
    ShowInput_Enabled=False,
    ShowInput_Path=True,
    SynchronousSolve=True)  # -> Cities, Loc_id; disabled
panel_4 = Panel("white")  # disabled
panel_5 = Panel("selectet Variable and remove 29-02")  # disabled
format_4 = Format(Format="{0}{1}\{2}.gh", Culture=127, Data0=relative_path, Data1=panel_4, Data2=panel_5)  # disabled
panel_6 = Panel(hops.Weather_data_1hrPath)  # disabled
hops_4 = Hops(
    _Path=format_4,
    Run=hops_2.Check,
    Weather_data_1hrPath=hops.Weather_data_1hrPath,
    Cities=hops_3.Cities,
    Loc_id=hops_3.Loc_id,
    CacheResultsInMemory=False,
    CacheSolveResults=False,
    RemoteDefinitionLocation="C:\Users\ionon\OneDrive - Università di Camerino\Documents\GitHub\unicamTools\white\selectet Variable and remove 29-02.gh",
    RemoteSolveVersion=(0, 1, 0),
    ShowInput_Enabled=False,
    ShowInput_Path=True,
    SynchronousSolve=True)  # -> Worksheet, SelectedLabels, SelectedData, Format; disabled
panel_7 = Panel(hops_4.SelectedLabels)  # disabled
