# Grasshopper definition Get cities from coordinates.gh (Grasshopper 1.0.7)

location_path = GetFilePath(AtLeast=1, AtMost=1, TreeAccess=False)
run = GetBoolean(AtLeast=1, AtMost=1, FalseValue="False", TreeAccess=False, TrueValue="True")
location_path_2 = Text(location_path)
run_2 = Boolean(run)
stream_filter = StreamFilter(Gate=run_2, Stream1=location_path_2)
read_file = ReadFile(File=stream_filter, PerLineParse=True)
cull_index = CullIndex(List=read_file, Indices=0, Wrap=True)
text_split = TextSplit(Text=cull_index, Separators=",")  # -> simplify(Result)
csv = ValueList({"id": "0", "lat": "1", "lon": "2", "place": "3"}, selected="place")
csv_2 = ValueList({"id": "0", "lat": "1", "lon": "2", "place": "3"}, selected="id")
csv_3 = ValueList({"id": "0", "lat": "1", "lon": "2", "place": "3"}, selected="lat")
csv_4 = ValueList({"id": "0", "lat": "1", "lon": "2", "place": "3"}, selected="lon")
flip_matrix = FlipMatrix(Data=text_split)  # -> simplify(Data)
tree_branch = TreeBranch(Tree=flip_matrix, Path=csv_2, MaintainPaths=True)
tree_branch_2 = TreeBranch(Tree=flip_matrix, Path=csv_3, MaintainPaths=True)
tree_branch_3 = TreeBranch(Tree=flip_matrix, Path=csv_4, MaintainPaths=True)
tree_branch_4 = TreeBranch(Tree=flip_matrix, Path=csv, MaintainPaths=True)
replace_text = ReplaceText(Text=tree_branch_4, Find="\"", RecursiveReplace=False)
cities = Text(replace_text)
sort_text = SortText(Keys=cities, Culture=127)  # -> Keys, Values
loc_id = Integer(tree_branch)
cities_2 = Text(sort_text.Keys)
context_bake = ContextBake(Geometry=loc_id)
context_print = ContextPrint(Cities=cities_2)
