# Grasshopper definition check directory consistence py.gh (Grasshopper 1.0.7)

weather_data_1hr_path = GetFilePath(AtLeast=1, AtMost=1, TreeAccess=False)
location_path = GetFilePath(AtLeast=1, AtMost=1, TreeAccess=False)
ghpython_script = GhPythonScript(path=location_path)  # -> out, exist
# ---------- ghpython_script: Python ----------
import rhinoscriptsyntax as rs
import os


if os.path.isfile(path):
    exist= True
elif os.path.isdir(path):
    exist= True
else:
    exist= False
# ---------- end ghpython_script ----------
ghpython_script_2 = GhPythonScript(path=weather_data_1hr_path)  # -> out, exist; same code as ghpython_script
error = Panel("Please, place the purchased files in the same directory as the repDay file")
ok = Panel("All done! :)")
gate_and = GateAnd(A=ghpython_script.exist, B=ghpython_script_2.exist)
stream_filter = StreamFilter(Gate=gate_and, Stream0=error, Stream1=ok)
stream_filter_2 = StreamFilter(Gate=gate_and, Stream0=0, Stream1=1)
check = Boolean(stream_filter_2)
message = Text(stream_filter)
context_print = ContextPrint(Message=message)
context_bake = ContextBake(Geometry=check)
