# Grasshopper definition check directory consistence.gh (Grasshopper 1.0.7)

weather_data_1hr_path = GetFilePath(AtLeast=1, AtMost=1, TreeAccess=False)
location_path = GetFilePath(AtLeast=1, AtMost=1, TreeAccess=False)
c_script = CSharpScript(path=location_path)  # -> out, FileExist, DirectoryExists; inputs path: String
# ---------- c_script: C# usings ----------
   using System.IO;
# ---------- c_script: C# ----------
    FileExist = System.IO.File.Exists(path);
    DirectoryExists = System.IO.Directory.Exists(path);
# ---------- end c_script ----------
c_script_2 = CSharpScript(path=weather_data_1hr_path)  # -> out, FileExist, DirectoryExists; inputs path: String; same code as c_script
gate_or = GateOr(A=c_script.FileExist, B=c_script.DirectoryExists)
gate_or_2 = GateOr(A=c_script_2.FileExist, B=c_script_2.DirectoryExists)
error = Panel("Please, place the purchased files in the same directory as the repDay file")
ok = Panel("All done! :)")
gate_and = GateAnd(A=gate_or, B=gate_or_2)
stream_filter = StreamFilter(Gate=gate_and, Stream0=error, Stream1=ok)
stream_filter_2 = StreamFilter(Gate=gate_and, Stream0=0, Stream1=1)
check = Boolean(stream_filter_2)
message = Text(stream_filter)
context_print = ContextPrint(Message=message)
context_bake = ContextBake(Geometry=check)
