# Grasshopper definition make directory paths.gh (Grasshopper 1.0.7)

weather_worksheet_name = GetString(AtLeast=1, AtMost=1, TreeAccess=False)
ghfilepath = GetFilePath(AtLeast=1, AtMost=1, TreeAccess=False)
db_workbook = GetString(AtLeast=1, AtMost=1, TreeAccess=False)
location_worksheet_name = GetString(AtLeast=1, AtMost=1, TreeAccess=False)
location_worksheet_name_2 = Text(location_worksheet_name)
weather_worksheet_name_2 = Text(weather_worksheet_name)
ghfilepath_2 = Data(ghfilepath)
db_workbook_2 = Text(db_workbook)
concatenate = Concatenate(Fragment_A=ghfilepath_2, Fragment_B=location_worksheet_name_2, A=".csv")
concatenate_2 = Concatenate(Fragment_A=ghfilepath_2, Fragment_B=weather_worksheet_name_2, A=".csv")
concatenate_3 = Concatenate(a=ghfilepath_2, b="weather\", c=location_worksheet_name_2, d=".csv")
concatenate_4 = Concatenate(a=ghfilepath_2, b="weather\", c=weather_worksheet_name_2, d=".csv")
weather_data_1hr_path = Data(concatenate_4)
db_workbook_3 = Text(db_workbook_2)
location_path = Data(concatenate_3)
context_bake = ContextBake(Weather_data_1hrPath=weather_data_1hr_path)
context_bake_2 = ContextBake(LocationPath=location_path)
context_bake_3 = ContextBake(DBWorkbook=db_workbook_3)
