# Grasshopper definition selected Variable and remove 29-02.gh (Grasshopper 1.0.7)

cities = GetString(AtLeast=1, AtMost=1, TreeAccess=False)
loc_id = GetInteger(AtLeast=1, AtMost=1, Maximum=2147483647, Minimum=-2147483648, TreeAccess=False)
weather_data_1hr_path = GetFilePath(AtLeast=1, AtMost=1, TreeAccess=False)
run = GetBoolean(AtLeast=1, AtMost=1, FalseValue="False", TreeAccess=False, TrueValue="True")
cache_path = GetFilePath(AtLeast=1, AtMost=1, TreeAccess=False)
run_2 = Boolean(run)
file_path = FilePath(weather_data_1hr_path)
file_path_2 = FilePath(cache_path)
stream_filter = StreamFilter(Gate=run_2, Stream1=file_path)
concatenate = Concatenate(FragmentA=file_path_2, FragmentB="selectedVariableCache.csv")
replace_text = ReplaceText(Text=stream_filter, Find="\\", Replace="\", RecursiveReplace=False)
text_trim = TextTrim(Text=replace_text, Start=True, End=True)
ghpython_script = GhPythonScript(path=concatenate)  # -> out, exist
# ---------- ghpython_script: Python ----------
import rhinoscriptsyntax as rs
import os


if os.path.isfile(path):
    exist= True
elif os.path.isdir(path):
    exist= True
else:
    exist= False
# ---------- end ghpython_script ----------
stream_gate = StreamGate(Stream=text_trim, Gate=ghpython_script.exist)  # -> Target0, Target1
read_file = ReadFile(File=stream_gate.Target0, PerLineParse=True)
stream_filter_2 = StreamFilter(Gate=ghpython_script.exist, Stream1=concatenate)
cities_2 = Text(cities)
city_index = Integer(loc_id)
read_file_2 = ReadFile(File=stream_filter_2, PerLineParse=True)
text_fragment = TextFragment(Text=read_file, Start=0, Count=3)
text_split = TextSplit(Text=text_fragment, Separators=",")
cull_index = CullIndex(List=read_file_2, Indices=0, Wrap=True)
list_item = ListItem(List=read_file_2, Index=0, Wrap=True)
list_item_2 = ListItem(List=text_split, Index=0, Wrap=True)  # -> flatten(Item)
cull_index_2 = CullIndex(List=list_item_2, Indices=0, Wrap=True)
cull_index_3 = CullIndex(List=read_file, Indices=0, Wrap=True)
list_item_3 = ListItem(List=read_file, Index=0, Wrap=True)
text_split_2 = TextSplit(Text=list_item, Separators=",")
text_split_3 = TextSplit(Text=cull_index, Separators=",")
create_set = CreateSet(List=cull_index_2)  # -> Set, Map
addition = Addition(A=create_set.Map, B=1)
data = Data(cull_index_3)

create_set_2 = CreateSet(List=flatten(addition))  # -> Set, Map
create_set_3 = CreateSet(List=create_set_2.Map)  # -> Set, Map
member_index = MemberIndex(Set=create_set_2.Map, Member=create_set_3.Set)  # -> Index, Count
list_item_4 = ListItem(List=data, Index=member_index.Index, Wrap=True)
tree_statistics = TreeStatistics(Tree=list_item_4)  # -> Paths, Length, Count
replace_paths = ReplacePaths(Data=list_item_4, Search=tree_statistics.Paths, Replace=create_set_2.Set)

tree_branch = TreeBranch(Tree=replace_paths, Path=city_index, MaintainPaths=True)
weather_data_1hr_header = ValueList({"loc_id": "0", "date": "1", "time": "2", "isdaytime": "3", "tempC": "4", "tempF": "5", "windspeedMiles": "6", "windspeedKmph": "7", "winddirdegree": "8", "winddir16point": "9"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}, selected="date")
text_split_4 = TextSplit(Text=list_item_3, Separators=",")  # -> simplify(graft(Result))
text_split_5 = TextSplit(Text=tree_branch, Separators=",")  # -> simplify(Result)
flip_matrix = FlipMatrix(Data=text_split_5)
tree_branch_2 = TreeBranch(Tree=flip_matrix, Path=weather_data_1hr_header, MaintainPaths=True)
time = Time(tree_branch_2)
weather_data_1hr_header_2 = ValueList({"loc_id": "0", "date": "1", "time": "2", "isdaytime": "3", "tempC": "4", "tempF": "5", "windspeedMiles": "6", "windspeedKmph": "7", "winddirdegree": "8", "winddir16point": "9"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}, selected=["loc_id", "date", "tempC", "windspeedKmph", "winddirdegree", "precipMM": "13", "humidity": "15", "visibilityKm": "16", "pressureMB": "18", "cloudcover": "20", "DewPointC": "23"])
weather_data_1hr_header_3 = ValueList({"loc_id": "0", "date": "1", "time": "2", "isdaytime": "3", "tempC": "4", "tempF": "5", "windspeedMiles": "6", "windspeedKmph": "7", "winddirdegree": "8", "winddir16point": "9"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}, selected=["winddirdegree", "precipMM": "13", "visibilityKm": "16", "pressureMB": "18", "cloudcover": "20", "DewPointC": "23"])
weather_data_1hr_header_4 = ValueList({"loc_id": "0", "date": "1", "time": "2", "isdaytime": "3", "tempC": "4", "tempF": "5", "windspeedMiles": "6", "windspeedKmph": "7", "winddirdegree": "8", "winddir16point": "9"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}, selected="windspeedKmph")
weather_data_1hr_header_5 = ValueList({"loc_id": "0", "date": "1", "time": "2", "isdaytime": "3", "tempC": "4", "tempF": "5", "windspeedMiles": "6", "windspeedKmph": "7", "winddirdegree": "8", "winddir16point": "9"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}, selected="humidity": "15")
weather_data_1hr_header_6 = ValueList({"loc_id": "0", "date": "1", "time": "2", "isdaytime": "3", "tempC": "4", "tempF": "5", "windspeedMiles": "6", "windspeedKmph": "7", "winddirdegree": "8", "winddir16point": "9"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}, selected="loc_id")
weather_data_1hr_header_7 = ValueList({"loc_id": "0", "date": "1", "time": "2", "isdaytime": "3", "tempC": "4", "tempF": "5", "windspeedMiles": "6", "windspeedKmph": "7", "winddirdegree": "8", "winddir16point": "9"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}, selected="time")
weather_data_1hr_header_8 = ValueList({"loc_id": "0", "date": "1", "time": "2", "isdaytime": "3", "tempC": "4", "tempF": "5", "windspeedMiles": "6", "windspeedKmph": "7", "winddirdegree": "8", "winddir16point": "9"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}, selected="tempC")
deconstruct_date = DeconstructDate(Date=time)  # -> Year, Month, Day, Hour, Minute, Second
equality = Equality(FirstNumber=deconstruct_date.Day, SecondNumber=29)  # -> Equality, Inequality
equality_2 = Equality(FirstNumber=deconstruct_date.Month, SecondNumber=2)  # -> Equality, Inequality
gate_nand = GateNand(A=equality_2.Equality, B=equality.Equality)
tree_branch_3 = TreeBranch(Tree=flip_matrix, Path=weather_data_1hr_header_4, MaintainPaths=True)
tree_branch_4 = TreeBranch(Tree=flip_matrix, Path=weather_data_1hr_header_5, MaintainPaths=True)
tree_branch_5 = TreeBranch(Tree=flip_matrix, Path=weather_data_1hr_header_7, MaintainPaths=True)
tree_branch_6 = TreeBranch(Tree=flip_matrix, Path=weather_data_1hr_header_8, MaintainPaths=True)
tree_branch_7 = TreeBranch(Tree=flip_matrix, Path=weather_data_1hr_header_6, MaintainPaths=True)
tree_branch_8 = TreeBranch(Tree=flip_matrix, Path=weather_data_1hr_header_3, MaintainPaths=True)
division = Division(A=tree_branch_5, B=100)
tree_branch_9 = TreeBranch(Tree=text_split_4, Path=weather_data_1hr_header_2, MaintainPaths=True)  # -> flatten(Branch)
division_2 = Division(A=tree_branch_3, B="3.6")
list_item_5 = ListItem(List=cities_2, Index=expr("x-1", tree_branch_7), Wrap=True)  # -> flatten(Item)
merge = Merge(Data1=tree_branch_9, Data2="UTCI (°C)")  # -> flatten(Result)
utci = LBUTCIComfort(air_temp=tree_branch_6, rel_humid=tree_branch_4, wind_vel=division_2, run=True)  # -> out, flatten(utci), comfort, condition, category, comf_obj; plug-in component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
replace_text_2 = ReplaceText(Text=merge, Find="tempC", Replace="temperature (°C)", RecursiveReplace=False)
replace_text_3 = ReplaceText(Text=replace_text_2, Find="windspeedKmph", Replace="wind speed (m/s)", RecursiveReplace=False)
concatenate_2 = Concatenate(FragmentA=tree_branch_2, FragmentB=division, JoinSeparator="-")
replace_text_4 = ReplaceText(Text=replace_text_3, Find="winddirdegree", Replace="wind direction (°)", RecursiveReplace=False)
unflatten_tree = UnflattenTree(Tree=concatenate_2, Guide=tree_branch_2)
replace_text_5 = ReplaceText(Text=replace_text_4, Find="precipMM", Replace="precip (mm)", RecursiveReplace=False)
path_mapper = PathMapper(utci.utci, source="{A}", target="{100}")
windspeed_m_s = Number(expr("Round(x,2)", division_2))
otherdata = Text(tree_branch_8)
newdate = Text(unflatten_tree)
humidity = Text(tree_branch_4)
utci_2 = Number(expr("Round(x,2)", path_mapper))
loc_id_2 = Text(list_item_5)
tempc = Text(tree_branch_6)
replace_text_6 = ReplaceText(Text=replace_text_5, Find="humidity", Replace="humidity (%)", RecursiveReplace=False)
merge_2 = Merge(Data1=loc_id_2, Data2=newdate, Data3=otherdata, Data4=tempc, Data5=windspeed_m_s, Data6=humidity, Data7=utci_2)
replace_text_7 = ReplaceText(Text=replace_text_6, Find="visibilityKm", Replace="visibility (Km)", RecursiveReplace=False)
path_mapper_2 = PathMapper(merge_2, source="{A}", target="{path_index}")
replace_text_8 = ReplaceText(Text=replace_text_7, Find="DewPointC", Replace="Dew Point (°C)", RecursiveReplace=False)
replace_text_9 = ReplaceText(Text=replace_text_8, Find="pressureMB", Replace="pressure (mB)", RecursiveReplace=False)
cull_pattern = CullPattern(List=path_mapper_2, CullPattern=gate_nand)
tree_branch_10 = TreeBranch(Tree=cull_pattern, Path="{0}", MaintainPaths=True)
flip_matrix_2 = FlipMatrix(Data=cull_pattern)
list_item_6 = ListItem(List=cities_2, Index=city_index, Wrap=True)
list_length = ListLength(List=tree_branch_10)  # -> expr("x+1", Length)
format = Format(Format="{0}#{1}", Culture=127, Data0=list_item_6, Data1=list_length)
member_index_2 = MemberIndex(Set=format, Member="#")  # -> Index, Count
text = Text(replace_text_9)
selected_data = Text(flip_matrix_2)
cull_index_4 = CullIndex(List=format, Indices=member_index_2.Index, Wrap=True)
entwine = Entwine(Branch00=text, Branch01=selected_data, FlattenInputs=True)
list_length_2 = ListLength(List=text)
equality_3 = Equality(FirstNumber=list_length_2, SecondNumber=1)  # -> Equality, Inequality
partition_list = PartitionList(List=entwine, Size=list_length_2)
cull_pattern_2 = CullPattern(List=partition_list, CullPattern=equality_3.Inequality)
cull_pattern_3 = CullPattern(List=concatenate, CullPattern=equality_3.Inequality)
write_cache = GhPythonScript(data=cull_pattern_2, file_path=cull_pattern_3)  # -> out; inputs data: tree
# ---------- write_cache: Python ----------
import csv

# Inserisci il percorso del file CSV che vuoi creare


# Inserisci qui l'albero di dati fornito dall'output di un altro componente
data_tree = data


# Crea una lista vuota per contenere i dati
data = []

# Itera attraverso i percorsi dell'albero di dati
for i in range(data_tree.BranchCount):
    # Ottieni i dati dal percorso corrente
    branch_data = data_tree.Branch(i)
    # Converte i dati in una stringa separata da virgole
    row = ','.join(map(str, branch_data))
    # Aggiungi la riga alla lista dei dati
    data.append(row)

# Apri il file CSV in modalità scrittura
with open(file_path, 'w') as csvfile:
    # Scrivi i dati nel file CSV
    for row in data:
        csvfile.write(row + '\n')
# ---------- end write_cache ----------
cull_pattern_4 = CullPattern(List=text, CullPattern=equality_3.Inequality)
merge_3 = Merge(Data1=selected_data, Data2=text_split_3)  # -> simplify(Result)
worksheet = Text(flatten(cull_index_4))  # disabled
merge_4 = Merge(Data1=cull_pattern_4, Data2=text_split_2)  # -> flatten(Result)
context_print = ContextPrint(SelectedLabels=merge_4)
context_print_2 = ContextPrint(SelectedData=merge_3)
