# Grasshopper definition selectet Variable and remove 29-02.gh (Grasshopper 1.0.7)

weather_data_1hr_path = GetFilePath(AtLeast=1, AtMost=1, TreeAccess=False)
run = GetBoolean(AtLeast=1, AtMost=1, FalseValue="False", TreeAccess=False, TrueValue="True")
run_2 = Boolean(run)
file_path = FilePath(weather_data_1hr_path)
panel = Panel("C:\\Users\\ionon\\OneDrive - Università di Camerino\\Desktop\\Ethel\\hwd_order_2660\\weather_data_1hr.csv")
stream_filter = StreamFilter(Gate=run_2, Stream1=file_path)
list_item = ListItem(List=stream_filter, Index=0, Wrap=True)
read_file = ReadFile(File=panel, PerLineParse=True)
cities = GetString(AtLeast=1, AtMost=1, TreeAccess=False)
loc_id = GetInteger(AtLeast=1, AtMost=1, Maximum=2147483647, Minimum=-2147483648, TreeAccess=False)
cities_2 = Text("Taranto")
city_index = Integer(Slider(1, range=0..1))
text = Text("0.00")
text_fragment = TextFragment(Text=read_file, Start=0, Count=3)
text_split = TextSplit(Text=text_fragment, Separators=",")
list_item_2 = ListItem(List=text_split, Index=0, Wrap=True)  # -> flatten(Item)
cull_index = CullIndex(List=list_item_2, Indices=0, Wrap=True)
cull_index_2 = CullIndex(List=read_file, Indices=0, Wrap=True)
list_item_3 = ListItem(List=read_file, Index=0, Wrap=True)
create_set = CreateSet(List=cull_index)  # -> Set, Map
addition = Addition(A=create_set.Map, B=1)
data = Data(cull_index_2)
data_2 = Data(flatten(data))
data_3 = Data(graft(data_2))
tree_statistics = TreeStatistics(Tree=data_3)  # -> Paths, Length, Count
replace_paths = ReplacePaths(Data=data_3, Search=tree_statistics.Paths, Replace=addition)
panel_2 = Panel(replace_paths)
tree_branch = TreeBranch(Tree=replace_paths, Path=city_index, MaintainPaths=True)
weather_data_1hr_header = ValueList({"loc_id": "0", "date": "1", "time": "2", "isdaytime": "3", "tempC": "4", "tempF": "5", "windspeedMiles": "6", "windspeedKmph": "7", "winddirdegree": "8", "winddir16point": "9"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}, selected="date")
text_split_2 = TextSplit(Text=list_item_3, Separators=",")  # -> simplify(graft(Result))
text_split_3 = TextSplit(Text=tree_branch, Separators=",")  # -> simplify(Result)
flip_matrix = FlipMatrix(Data=text_split_3)
tree_branch_2 = TreeBranch(Tree=flip_matrix, Path=weather_data_1hr_header, MaintainPaths=True)
time = Time(tree_branch_2)
weather_data_1hr_header_2 = ValueList({"loc_id": "0", "date": "1", "time": "2", "isdaytime": "3", "tempC": "4", "tempF": "5", "windspeedMiles": "6", "windspeedKmph": "7", "winddirdegree": "8", "winddir16point": "9"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}, selected=["loc_id", "date", "tempC", "windspeedKmph", "winddirdegree", "precipMM": "13", "humidity": "15", "visibilityKm": "16", "pressureMB": "18", "cloudcover": "20", "DewPointC": "23"])
weather_data_1hr_header_3 = ValueList({"loc_id": "0", "date": "1", "time": "2", "isdaytime": "3", "tempC": "4", "tempF": "5", "windspeedMiles": "6", "windspeedKmph": "7", "winddirdegree": "8", "winddir16point": "9"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}, selected=["winddirdegree", "precipMM": "13", "visibilityKm": "16", "pressureMB": "18", "cloudcover": "20", "DewPointC": "23"])
weather_data_1hr_header_4 = ValueList({"loc_id": "0", "date": "1", "time": "2", "isdaytime": "3", "tempC": "4", "tempF": "5", "windspeedMiles": "6", "windspeedKmph": "7", "winddirdegree": "8", "winddir16point": "9"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}, selected="windspeedKmph")
weather_data_1hr_header_5 = ValueList({"loc_id": "0", "date": "1", "time": "2", "isdaytime": "3", "tempC": "4", "tempF": "5", "windspeedMiles": "6", "windspeedKmph": "7", "winddirdegree": "8", "winddir16point": "9"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}, selected="humidity": "15")
weather_data_1hr_header_6 = ValueList({"loc_id": "0", "date": "1", "time": "2", "isdaytime": "3", "tempC": "4", "tempF": "5", "windspeedMiles": "6", "windspeedKmph": "7", "winddirdegree": "8", "winddir16point": "9"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}, selected="loc_id")
weather_data_1hr_header_7 = ValueList({"loc_id": "0", "date": "1", "time": "2", "isdaytime": "3", "tempC": "4", "tempF": "5", "windspeedMiles": "6", "windspeedKmph": "7", "winddirdegree": "8", "winddir16point": "9"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}, selected="time")
weather_data_1hr_header_8 = ValueList({"loc_id": "0", "date": "1", "time": "2", "isdaytime": "3", "tempC": "4", "tempF": "5", "windspeedMiles": "6", "windspeedKmph": "7", "winddirdegree": "8", "winddir16point": "9"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}, selected="tempC")
deconstruct_date = DeconstructDate(Date=time)  # -> Year, Month, Day, Hour, Minute, Second
equality = Equality(FirstNumber=deconstruct_date.Month, SecondNumber=2)  # -> Equality, Inequality
equality_2 = Equality(FirstNumber=deconstruct_date.Day, SecondNumber=29)  # -> Equality, Inequality
gate_nand = GateNand(A=equality.Equality, B=equality_2.Equality)
tree_branch_3 = TreeBranch(Tree=flip_matrix, Path=weather_data_1hr_header_4, MaintainPaths=True)
tree_branch_4 = TreeBranch(Tree=flip_matrix, Path=weather_data_1hr_header_5, MaintainPaths=True)
tree_branch_5 = TreeBranch(Tree=flip_matrix, Path=weather_data_1hr_header_7, MaintainPaths=True)
tree_branch_6 = TreeBranch(Tree=flip_matrix, Path=weather_data_1hr_header_8, MaintainPaths=True)
tree_branch_7 = TreeBranch(Tree=flip_matrix, Path=weather_data_1hr_header_6, MaintainPaths=True)
tree_branch_8 = TreeBranch(Tree=flip_matrix, Path=weather_data_1hr_header_3, MaintainPaths=True)
tree_branch_9 = TreeBranch(Tree=text_split_2, Path=weather_data_1hr_header_2, MaintainPaths=True)  # -> flatten(Branch)
division = Division(A=tree_branch_5, B=100)
division_2 = Division(A=tree_branch_3, B="3.6")
list_item_4 = ListItem(List=cities_2, Index=expr("x-1", tree_branch_7), Wrap=True)  # -> flatten(Item)
merge = Merge(Data1=tree_branch_9, Data2="UTCI (°C)")  # -> flatten(Result)
utci = LBUTCIComfort(air_temp=tree_branch_6, rel_humid=tree_branch_4, wind_vel=division_2, run=True)  # -> out, utci, comfort, condition, category, comf_obj; plug-in component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
replace_text = ReplaceText(Text=merge, Find="tempC", Replace="temperature (°C)", RecursiveReplace=False)
replace_text_2 = ReplaceText(Text=replace_text, Find="windspeedKmph", Replace="wind speed (m/s)", RecursiveReplace=False)
concatenate = Concatenate(FragmentA=tree_branch_2, FragmentB=division, JoinSeparator="-")
replace_text_3 = ReplaceText(Text=replace_text_2, Find="winddirdegree", Replace="wind direction (°)", RecursiveReplace=False)
unflatten_tree = UnflattenTree(Tree=concatenate, Guide=tree_branch_2)
replace_text_4 = ReplaceText(Text=replace_text_3, Find="precipMM", Replace="precip (mm)", RecursiveReplace=False)
path_mapper = PathMapper(utci.utci, source="{A}", target="{100}")
windspeed_m_s = Number(expr("Round(x,2)", division_2))
otherdata = Text(tree_branch_8)
newdate = Text(unflatten_tree)
humidity = Text(tree_branch_4)
utci_2 = Number(expr("Round(x,2)", path_mapper))
loc_id_2 = Text(list_item_4)
tempc = Text(tree_branch_6)
replace_text_5 = ReplaceText(Text=replace_text_4, Find="humidity", Replace="humidity (%)", RecursiveReplace=False)
merge_2 = Merge(Data1=loc_id_2, Data2=newdate, Data3=otherdata, Data4=tempc, Data5=windspeed_m_s, Data6=humidity, Data7=utci_2)
replace_text_6 = ReplaceText(Text=replace_text_5, Find="visibilityKm", Replace="visibility (Km)", RecursiveReplace=False)
path_mapper_2 = PathMapper(merge_2, source="{A}", target="{path_index}")
replace_text_7 = ReplaceText(Text=replace_text_6, Find="DewPointC", Replace="Dew Point (°C)", RecursiveReplace=False)
replace_text_8 = ReplaceText(Text=replace_text_7, Find="pressureMB", Replace="pressure (mB)", RecursiveReplace=False)
cull_pattern = CullPattern(List=path_mapper_2, CullPattern=gate_nand)
tree_branch_10 = TreeBranch(Tree=cull_pattern, Path="{0}", MaintainPaths=True)
flip_matrix_2 = FlipMatrix(Data=cull_pattern)
list_item_5 = ListItem(List=cities_2, Index=city_index, Wrap=True)
list_length = ListLength(List=tree_branch_10)  # -> expr("x+1", Length)
format = Format(Format="{0}#{1}", Culture=127, Data0=list_item_5, Data1=list_length)
member_index = MemberIndex(Set=format, Member="#")  # -> Index, Count
text_2 = Text(replace_text_8)
selected_data = Text(flip_matrix_2)
cull_index_3 = CullIndex(List=format, Indices=member_index.Index, Wrap=True)
longest_list = LongestList(ListListA=selected_data, ListListB=text, PaddingMode=2)  # -> ListListA, ListListB
worksheet = Text(flatten(cull_index_3))
format_2 = Text(longest_list.ListListB)
context_print = ContextPrint(SelectedLabels=text_2)
context_print_2 = ContextPrint(Worksheet=worksheet)
context_print_3 = ContextPrint(Format=format_2)
context_print_4 = ContextPrint(SelectedData=selected_data)
